# Grasshopper definition 001_OpenModelParams.gh (Grasshopper 1.0.7)
# Copyright: Arup
# plug-ins: GSA

panel = Panel("C:\Users\Kristjan.Nielsen\Desktop\GSA-Grasshoppe\Cantilever model.gwb")
opengsa = OpenModel(FilenameAndPath=panel, Guid=panel)
gsa = GSAModel(opengsa)
getanalysis = GetModelAnalysis(GSAModel=gsa)  # -> AnalysisTasks, AnalysisCaseNames, LoadCaseCombinationID, AnalysisCaseDescription
getgeo = GetModelGeometry(GSAModel=gsa, NodeFilterList="All", ElementFilterList="All", MemberFilterList="All", Mode=0)  # -> Nodes, _1DElements, _2DElements, _3DElements, _1DMembers, _2DMembers, _3DMembers
getloads = GetModelLoads(GSAModel=gsa)  # -> GravityLoads, NodeLoads, BeamLoads, FaceLoads, GridPointLoads, GridLineLoads, GridAreaLoads, GridPlaneSurfaces
getprops = GetModelProperties(GSAModel=gsa)  # -> Sections, _2DProperties, Springs
panel_2 = Panel(getanalysis.AnalysisTasks)
panel_3 = Panel(getanalysis.AnalysisCaseNames)
no = Node(getgeo.Nodes)
e1d = _1DElement(getgeo._1DElements)
e2d = _2DElement(getgeo._2DElements)
gps = GridPlaneSurface(getloads.GridPlaneSurfaces)
pb = Section(getprops.Sections)
pa = _2DProperty(getprops._2DProperties)
ps = Spring(getprops.Springs)
m1d = _1DMember(getgeo._1DMembers)
m2d = _2DMember(getgeo._2DMembers)
m3d = _3DMember(getgeo._3DMembers)
ld = Load([getloads.GravityLoads, getloads.NodeLoads, getloads.BeamLoads, getloads.FaceLoads, getloads.GridPointLoads, getloads.GridLineLoads, getloads.GridAreaLoads])
panel_4 = Panel(getanalysis.LoadCaseCombinationID)
panel_5 = Panel(getanalysis.AnalysisCaseDescription)
b6 = Bool6()
of = Offset()
