# Grasshopper definition 101_CreatePA-PB.gh (Grasshopper 1.0.7)
# Copyright: Arup
# plug-ins: GSA

crv = Curve(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)
profile = CreateProfile(
    Mode=0,
    catalogueIndex=1,
    catalogueProfileIndex=8,
    catalogueProfileName="HE120.B",
    catalogueTypeIndex=1,
    catalogueTypeName="HE",
    isB2B=False,
    isElliptical=False,
    isGeneral=False,
    isHollow=False,
    isTapered=False,
    loadlistid=3,
    loadselectid=8,
    Profile_type="Catalogue",
    Catalogue="Europrofile",
    Type="EP HE beams -- HE",
    Profile="HE120.B")
profile_2 = CreateProfile(
    Boundary=crv,
    Mode=7,
    catalogueIndex=1,
    catalogueProfileIndex=8,
    catalogueProfileName="HE120.B",
    catalogueTypeIndex=1,
    catalogueTypeName="HE",
    isB2B=False,
    isElliptical=False,
    isGeneral=False,
    isHollow=False,
    isTapered=False,
    loadlistid=0,
    loadselectid=2,
    Profile_type="Geometric",
    Catalogue="Europrofile",
    Type="EP HE beams -- HE",
    Profile="HE120.B")
profile_3 = CreateProfile(
    DepthMm=Slider(19, range=0..100),
    WidthMm=Slider(2.6, range=0..10),
    WebTHKMm=Slider(3, range=0..10),
    FlangeTHKMm=Slider(1.5, range=0..10),
    Mode=1,
    catalogueIndex=0,
    catalogueProfileIndex=0,
    catalogueTypeIndex=0,
    isB2B=True,
    isElliptical=True,
    isGeneral=True,
    isHollow=True,
    isTapered=False,
    loadlistid=1,
    loadselectid=0,
    Profile_type="Standard",
    Shape="Rectangle",
    selectioncontents2="Universal Beams (BS4-1:1980) -- UB",
    selectioncontents3="UB914x419x388")
section = CreateSection(Profile="STD R 850 300", Pool=0, Number=0)
section_2 = CreateSection(Profile=profile, Pool=0, Number=0)
section_3 = CreateSection(Profile=profile_2, Pool=0, Number=0)
panel = Panel(profile_3)
sectprop = SectionProperties(Section=section)  # -> Area, MomentOfInertiaYY, MomentOfInertiaZZ, MomentOfInertiaYZ, TorsionConstant, ShearAreaFactorInY, ShearAreaFactorInZ, SurfaceALength, VolumeLength
sectprop_2 = SectionProperties(Section=profile_3)  # -> Area, MomentOfInertiaYY, MomentOfInertiaZZ, MomentOfInertiaYZ, TorsionConstant, ShearAreaFactorInY, ShearAreaFactorInZ, SurfaceALength, VolumeLength
pb = Section(section_2)
analyse = AnalyseModel(GSAProperties=section_3)
panel_2 = Panel(sectprop.Area)
panel_3 = Panel([sectprop_2.Area, sectprop_2.MomentOfInertiaYY, sectprop_2.MomentOfInertiaZZ, sectprop_2.MomentOfInertiaYZ])
prop2d = Create2DProperty(Number=0, Mode=3)
savegsa = SaveModel(GSAModel=analyse)
pa = _2DProperty(prop2d)
