# Grasshopper definition 204_Mem1Ds-GhTransform.gh (Grasshopper 1.0.7)
# Copyright: Arup
# plug-ins: GSA

profile = CreateProfile(
    Mode=0,
    catalogueIndex=10,
    catalogueProfileIndex=201,
    catalogueProfileName="RHS300x100x10",
    catalogueTypeIndex=2,
    catalogueTypeName="EN-RHS",
    isB2B=False,
    isElliptical=False,
    isGeneral=False,
    isHollow=False,
    isTapered=False,
    loadlistid=3,
    loadselectid=201,
    Profile_type="Catalogue",
    Catalogue="EN 10210",
    Type="RHS (EN10210-2:2006) -- EN-RHS",
    Profile="RHS300x100x10")
profile_2 = CreateProfile(
    Mode=0,
    catalogueIndex=1,
    catalogueProfileIndex=1,
    catalogueProfileName="HE100.A",
    catalogueTypeIndex=1,
    catalogueTypeName="HE",
    isB2B=False,
    isElliptical=False,
    isGeneral=False,
    isHollow=False,
    isTapered=False,
    loadlistid=3,
    loadselectid=1,
    Profile_type="Catalogue",
    Catalogue="Europrofile",
    Type="EP HE beams -- HE",
    Profile="HE100.A")
profile_3 = CreateProfile(
    Mode=0,
    catalogueIndex=1,
    catalogueProfileIndex=74,
    catalogueProfileName="HE400.B",
    catalogueTypeIndex=1,
    catalogueTypeName="HE",
    isB2B=False,
    isElliptical=False,
    isGeneral=False,
    isHollow=False,
    isTapered=False,
    loadlistid=3,
    loadselectid=74,
    Profile_type="Catalogue",
    Catalogue="Europrofile",
    Type="EP HE beams -- HE",
    Profile="HE400.B")
rectangle = Rectangle(Plane=PlaneXY(0, 0, 0), XSize=Slider(12.15, range=0..15), YSize=Slider(8.1, range=0..15), Radius=0)  # -> Rectangle, Length
section = CreateSection(Profile=profile_2, Pool=0, Number=0)
section_2 = CreateSection(Profile=profile_3, Pool=0, Number=0)
explode = Explode(Curve=rectangle.Rectangle, Recursive=True)  # -> Segments, Vertices
section_3 = CreateSection(Profile=profile, Pool=0, Number=0)
dispatch = Dispatch(List=explode.Segments, DispatchPattern=[True, False])  # -> ListA, ListB
item = ListItem(List=reverse(dispatch.ListB), Index=0, Wrap=True)
mem1d = Create1DMember(
    Curve=dispatch.ListA,
    Section=section_2,
    x1=False,
    x2=False,
    xx1=False,
    xx2=False,
    y1=False,
    y2=False,
    yy1=False,
    yy2=False,
    z1=False,
    z2=False,
    zz1=False,
    zz2=False)
mem1d_2 = Create1DMember(
    Curve=item,
    Section=section,
    x1=False,
    x2=False,
    xx1=False,
    xx2=False,
    y1=False,
    y2=False,
    yy1=False,
    yy2=False,
    z1=False,
    z2=False,
    zz1=False,
    zz2=False)
Z = UnitZ(Factor=Slider(4.8, range=0..10))
move = Move(Geometry=mem1d, Motion=Z)  # -> Geometry, Transform
move_2 = Move(Geometry=mem1d_2, Motion=Z)  # -> Geometry, Transform
X = UnitX(Factor=Slider(4.05, range=0..15))
end = EndPoints(Curve=mem1d)  # -> Start, End
end_2 = EndPoints(Curve=move.Geometry)  # -> Start, End
ln = Line(StartPoint=[end.Start, end.End], EndPoint=[end_2.Start, end_2.End])
arrlinear = LinearArray(Geometry=move_2.Geometry, Direction=X, Count=Slider(4, range=0..15))  # -> Geometry, Transform
mem1d_3 = Create1DMember(
    Curve=ln,
    Section=section_3,
    x1=False,
    x2=False,
    xx1=False,
    xx2=False,
    y1=False,
    y2=False,
    yy1=False,
    yy2=False,
    z1=False,
    z2=False,
    zz1=False,
    zz2=False)
m1d = _1DMember([mem1d_3, arrlinear.Geometry, move.Geometry])
move_3 = Move(Geometry=m1d, Motion=Z)  # -> Geometry, Transform
analyse = AnalyseModel(GSAGeometry=flatten([m1d, move_3.Geometry]))
savegsa = SaveModel(GSAModel=analyse)
