# Grasshopper definition 299_Prob+Geo-relationship.gh (Grasshopper 1.0.7)
# Copyright: Arup
# plug-ins: GSA

panel = Panel("C:\Users\Kristjan.Nielsen\Desktop\GSA-Grasshoppe\Cantilever model.gwb")
pt = ConstructPoint(XCoordinate=0, YCoordinate=0, ZCoordinate=0)
pt_2 = ConstructPoint(XCoordinate=0, YCoordinate=Slider(9.8, range=0..10), ZCoordinate=0)
ln = Line(StartPoint=pt, EndPoint=pt_2)
ln_2 = Line(StartPoint=pt, EndPoint=pt_2)
mplane = MeshPlane(Boundary={Plane=PlaneXY(0, 0, 0), Size=Domain2(u=-10..10, v=-10..10)}, WidthCount=10, HeightCount=10)  # -> Mesh, Area
rectangle = Rectangle(Plane=PlaneXY(0, 0, 0), XSize=Domain(-1, 1), YSize=Domain(-2, 2), Radius=0)  # -> Rectangle, Length
opengsa = OpenModel(FilenameAndPath=panel, Guid=panel)
gsa = GSAModel(opengsa)
pt_3 = ConstructPoint(XCoordinate=0, YCoordinate=0, ZCoordinate=0)
pt_4 = ConstructPoint(XCoordinate=0, YCoordinate=Slider(9.8, range=0..10), ZCoordinate=0)
pt_5 = ConstructPoint(XCoordinate=0, YCoordinate=0, ZCoordinate=0)
pt_6 = ConstructPoint(XCoordinate=0, YCoordinate=Slider(9.8, range=0..10), ZCoordinate=0)
section = CreateSection(Profile="STD I 1000 500 15 25", Pool=0, Number=0)
section_2 = CreateSection(Profile="STD I 1000 500 15 25", Pool=0, Number="42")
mesh = Mesh(mplane.Mesh)
brep = Brep(rectangle.Rectangle)
crv = Curve(ln_2)
line = Line(ln)
getgeo = GetModelGeometry(GSAModel=gsa, NodeFilterList="All", ElementFilterList="All", MemberFilterList="All", Mode=0)  # -> Nodes, _1DElements, _2DElements, _3DElements, _1DMembers, _2DMembers, _3DMembers
prop2d = Create2DProperty(Number=0, Mode=3)
section_3 = CreateSection(Profile="STD I 1000 500 15 25", Pool=0, Number=0)
ln_3 = Line(StartPoint=pt_3, EndPoint=pt_4)
ln_4 = Line(StartPoint=pt_5, EndPoint=pt_6)
pb = Section(section_3)
pa = _2DProperty(prop2d)
elem1d = Create1DElement(Line=ln_3, Section=section)
elem1d_2 = Create1DElement(Line=ln_4, Section="42")
m1d = _1DMember(getgeo._1DMembers)
m2d = _2DMember(getgeo._2DMembers)
mem1dedit = Edit1DMember(_1DMember=m1d, MeshWithOthers=True)  # -> _1DMember, Curve, Section, MemberType, _1DElementType, Offset, StartRelease, EndRelease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
mem2dedit = Edit2DMember(_2DMember=m2d, MeshWithOthers=True)  # -> _2DMember, Brep, _2DProperty, Offset, InclPoints, InclCurves, MeshSize, MeshWithOthers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
mem2d = Create2DMember(Brep=brep, _2DProperty=pa, MeshSize=0)
mem1d = Create1DMember(
    Curve=crv,
    Section=pb,
    x1=False,
    x2=False,
    xx1=False,
    xx2=False,
    y1=False,
    y2=False,
    yy1=False,
    yy2=False,
    z1=False,
    z2=False,
    zz1=False,
    zz2=False)
elem2d = Create2DElement(Mesh=mesh, _2DProperty=pa)
elem1d_3 = Create1DElement(Line=line, Section=pb)
analyse = AnalyseModel(GSAGeometry=elem1d)
analyse_2 = AnalyseModel(GSAProperties=section_2, GSAGeometry=elem1d_2)
prop2dedit = Edit2DProperty(_2DProperty=mem2dedit._2DProperty)  # -> _2DProperty, Prop2dNumber, Prop2dName, Prop2dColour, Axis, Material, Thickness, Type
sectionedit = EditSection(Section=mem1dedit.Section)  # -> Section, SectionProfile, Material, SectionPool, SectionNumber, SectionName, SectionColour
e2d = _2DElement(elem2d)
e1d = _1DElement(elem1d_3)
m1d_2 = _1DMember(mem1d)
m2d_2 = _2DMember(mem2d)
getgeo_2 = GetModelGeometry(GSAModel=analyse, NodeFilterList="All", ElementFilterList="All", MemberFilterList="All", Mode=0)  # -> Nodes, _1DElements, _2DElements, _3DElements, _1DMembers, _2DMembers, _3DMembers
getgeo_3 = GetModelGeometry(GSAModel=analyse_2, NodeFilterList="All", ElementFilterList="All", MemberFilterList="All", Mode=0)  # -> Nodes, _1DElements, _2DElements, _3DElements, _1DMembers, _2DMembers, _3DMembers
panel_2 = Panel(sectionedit.SectionProfile)
sectprop = SectionProperties(Section=sectionedit.Section)  # -> Area, MomentOfInertiaYY, MomentOfInertiaZZ, MomentOfInertiaYZ, TorsionConstant, ShearAreaFactorInY, ShearAreaFactorInZ, SurfaceALength, VolumeLength
panel_3 = Panel(prop2dedit.Prop2dNumber)
panel_4 = Panel(prop2dedit.Prop2dName)
elem2dedit = Edit2DElement(_2DElement=e2d)  # -> _2DElement, AnalysisMesh, _2DProperty, Offset, ElementType, Number, Name, Group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
elem1dedit = Edit1DElement(_1DElement=e1d)  # -> _1DElement, Line, Section, Offset, StartRelease, EndRelease, OrientationAngle, OrientationNode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
panel_5 = Panel(sectprop.Area)
panel_6 = Panel(sectionedit.SectionName)
elem1dedit_2 = Edit1DElement(_1DElement=getgeo_2._1DElements)  # -> _1DElement, Line, Section, Offset, StartRelease, EndRelease, OrientationAngle, OrientationNode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
elem1dedit_3 = Edit1DElement(_1DElement=getgeo_3._1DElements)  # -> _1DElement, Line, Section, Offset, StartRelease, EndRelease, OrientationAngle, OrientationNode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
mem2dedit_2 = Edit2DMember(_2DMember=m2d_2, MeshWithOthers=True)  # -> _2DMember, Brep, _2DProperty, Offset, InclPoints, InclCurves, MeshSize, MeshWithOthers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
mem1dedit_2 = Edit1DMember(_1DMember=m1d_2, MeshWithOthers=True)  # -> _1DMember, Curve, Section, MemberType, _1DElementType, Offset, StartRelease, EndRelease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
panel_7 = Panel(elem1dedit_2.Section)
panel_8 = Panel(elem1dedit_3.Section)
pa_2 = _2DProperty(elem2dedit._2DProperty)
pa_3 = _2DProperty(mem2dedit_2._2DProperty)
pb_2 = Section(elem1dedit.Section)
pb_3 = Section(mem1dedit_2.Section)
panel_9 = Panel(pb_2)
panel_10 = Panel(pb_3)
panel_11 = Panel(pa_2)
panel_12 = Panel(pa_3)
