# Grasshopper definition 401_Analysis_SimpleCantilever.gh (Grasshopper 1.0.7)
# plug-ins: GSA

panel = Panel("C:\Users\Kristjan.Nielsen\Desktop\GSA-Grasshoppe\BaseModel.gwb")
profile = CreateProfile(
    Mode=0,
    catalogueIndex=1,
    catalogueProfileIndex=23,
    catalogueProfileName="HE180.B",
    catalogueTypeIndex=1,
    catalogueTypeName="HE",
    isB2B=False,
    isElliptical=False,
    isGeneral=False,
    isHollow=False,
    isTapered=False,
    loadlistid=3,
    loadselectid=23,
    Profile_type="Catalogue",
    Catalogue="Europrofile",
    Type="EP HE beams -- HE",
    Profile="HE180.B")
open = OpenModel(FilenameAndPath=panel, File="C:\Users\Kristjan.Nielsen\Desktop\GSA-Grasshoppe\BaseModel.gwb")
pt = ConstructPoint(XCoordinate=0, YCoordinate=0, ZCoordinate=0)
pt_2 = ConstructPoint(XCoordinate=0, YCoordinate=Slider(6, range=0..100), ZCoordinate=0)
section = CreateSection(Profile=profile, Material="1", Pool=0, Number="1")
ln = Line(StartPoint=pt, EndPoint=pt_2)
support = CreateSupport(Point=pt, Plane=PlaneXY(0, 0, 0), x=True, xx=True, y=True, yy=True, z=True, zz=True)
mem1d = Create1DMember(
    Curve=ln,
    Section=section,
    x1=False,
    x2=False,
    xx1=False,
    xx2=False,
    y1=False,
    y2=False,
    yy1=False,
    yy2=False,
    z1=False,
    z2=False,
    zz1=False,
    zz2=False)
gravityload = CreateGravityLoad(LoadCase=1, ElementList="All", GravityFactor=Vector(0, 0, -1))
asyncanalyse = AsyncAnalyseModel(ModelS=open, GSAGeometry=[support, mem1d], GSALoad=gravityload)
elem1dresults = _1DElementResults(GSAModel=asyncanalyse, LoadCase=1, ElementFilterList="All", NoPositions=10, Scale=10, Display=3, Mode=0)  # -> Translation, Rotation, Line, Co, Colours, Values
noderesult = NodeResults(GSAModel=asyncanalyse, LoadCase=1, NodeFilterList="All", Scalar=10, Display=2, Mode=1)  # -> Force, Moment, Point, Co, Colours, Values
legend = Legend(Colour=noderesult.Colours, Tags=noderesult.Values, LegendType=1)
legend_2 = Legend(Colour=elem1dresults.Colours, Tags=elem1dresults.Values, LegendType=1)
vlen = VectorLength(Vector=noderesult.Force)
sort = SortList(Keys=vlen, ValuesA=noderesult.Point)  # -> Keys, ValuesA
item = ListItem(List=reverse(sort.ValuesA), Index=0, Wrap=True)
item_2 = ListItem(List=reverse(sort.Keys), Index=0, Wrap=True)
tag = TextTag(Location=item, Text=item_2, Colour=ColourSwatch(SwatchColor=RGB(0, 0, 0)))
