# Grasshopper definition 402_Analysis_Surface.gh (Grasshopper 1.0.7)
# Copyright: Arup
# plug-ins: GSA, sof_gh_sofistik_rhino

panel = Panel("C:\Users\Kristjan.Nielsen\Desktop\GSA-Grasshoppe\BaseModel.gwb")
io = IO(
    SofistikDocumentProperties_VersionMajor="2020",
    SofistikDocumentProperties_VersionMinor="8",
    SofistikDocumentProperties_VersionName="Rhino-Interface")
open = OpenModel(FilenameAndPath=panel, File="C:\Users\Kristjan.Nielsen\Desktop\GSA-Grasshoppe\BaseModel.gwb")
pt = ConstructPoint(XCoordinate=Slider(-4.6, range=-5..5), YCoordinate=Slider(2.1, range=-5..5), ZCoordinate=0)
pt_2 = ConstructPoint(XCoordinate=Slider(1.8, range=-5..5), YCoordinate=Slider(3.5, range=-5..5), ZCoordinate=0)
pt_3 = ConstructPoint(XCoordinate=Slider(1.2, range=-5..5), YCoordinate=Slider(-4.1, range=-5..5), ZCoordinate=0)
pt_4 = ConstructPoint(XCoordinate=Slider(-5, range=-5..5), YCoordinate=Slider(-5, range=-5..5), ZCoordinate=0)
material = CreateMaterial(AnalysisProperty=0, Grade=1, Mode=2)
srf4pt = _4PointSurface(CornerA=pt_4, CornerB=pt, CornerC=pt_2, CornerD=pt_3)
pt_5 = Point([pt_4, pt, pt_2, pt_3])
prop2d = Create2DProperty(Material=material, ThicknessFt=Slider(0.751, range=0..1), Mode=3)
support = CreateSupport(Point=pt_5, Plane=PlaneXY(0, 0, 0), x=True, xx=False, y=True, yy=False, z=True, zz=False)
mem2d = Create2DMember(Brep=srf4pt, _2DProperty=prop2d, MeshSize=Slider(0.5, range=0..1))
gsa = GSAModel(open)
gravityload = CreateGravityLoad(LoadCase=1, ElementList="All", GravityFactor=Vector(0, 0, -1))
faceload = CreateFaceLoad(LoadCase=1, ElementList="all", Axis=-1, Direction="z", Projected=False, ValueKNM²=Slider(-8, range=-10..0), Mode=0)
analyse = AnalyseModel(ModelS=gsa, GSAGeometry=[support, mem2d], GSALoad=[gravityload, faceload], Analyse=True, ReMesh=True)
elem2dresults = _2DElementResults(
    GSAModel=analyse,
    LoadCase=1,
    ElementFilterList="All",
    Display=1,
    Mode=3,
    flayer=-1,
    noDec=0,
    slider=False,
    val=0,
    valMax=100,
    valMin=0)  # -> ProjectedStressVector, ProjectedShearStressVector, Mesh, Colours, Values
cluster = Cluster(C=elem2dresults.Mesh)
devec = DeconstructVector(Vector=elem2dresults.ProjectedStressVector)  # -> XComponent, YComponent, ZComponent
legend = Legend(Colour=elem2dresults.Colours, Tags=elem2dresults.Values, Rectangle=cluster, LegendType=1)
panel_2 = Panel(devec.XComponent)
panel_3 = Panel(devec.YComponent)
panel_4 = Panel(devec.ZComponent)

# ==== cluster Cluster
io = IO(
    SofistikDocumentProperties_VersionMajor="2020",
    SofistikDocumentProperties_VersionMinor="8",
    SofistikDocumentProperties_VersionName="Rhino-Interface")
C = ClusterInput()
bbox = BoundingBox(Content=C, Plane=PlaneXY(0, 0, 0), UnionBox=True)  # -> Box, Box_2
project = Project(Geometry=bbox.Box, Plane=PlaneXY(0, 0, 0))  # -> Geometry, Transform
Y = UnitY(Factor="-1")
box_corners = BoxCorners(Box=project.Geometry)  # -> CornerA, CornerB, CornerC, CornerD, CornerE, CornerF, CornerG, CornerH
move = Move(Geometry=box_corners.CornerA, Motion=Y)  # -> Geometry, Transform
rectangle = Rectangle(Plane=move.Geometry, XSize="-1", YSize="-2", Radius=0)  # -> Rectangle, Length
R = ClusterOutput(rectangle.Rectangle)
