# Grasshopper definition 403_Analysis_Surface_Optimisation.gh (Grasshopper 1.0.7)
# Copyright: Arup
# plug-ins: GSA, sof_gh_sofistik_rhino

panel = Panel("C:\Users\Kristjan.Nielsen\Desktop\GSA-Grasshoppe\BaseModel.gwb")
panel_2 = Panel("C:\Users\Kristjan.Nielsen\Desktop\GSA-Grasshoppe\BaseModel.gwb")
io = IO(
    SofistikDocumentProperties_VersionMajor="2020",
    SofistikDocumentProperties_VersionMinor="8",
    SofistikDocumentProperties_VersionName="Rhino-Interface")
number_slider = Slider(0.471, range=0..1)
number_slider_2 = Slider(0.531, range=0..1)
open = OpenModel(FilenameAndPath=panel_2, File="C:\Users\Kristjan.Nielsen\Desktop\GSA-Grasshoppe\BaseModel.gwb")
pt = ConstructPoint(XCoordinate=0, YCoordinate=Slider(21, range=0..100), ZCoordinate=0)
pt_2 = ConstructPoint(XCoordinate=Slider(26, range=0..100), YCoordinate=Slider(24, range=0..100), ZCoordinate=0)
pt_3 = ConstructPoint(XCoordinate=0, YCoordinate=0, ZCoordinate=0)
pt_4 = ConstructPoint(XCoordinate=Slider(31, range=0..100), YCoordinate=Slider(1, range=0..100), ZCoordinate=0)
pt_5 = ConstructPoint(XCoordinate=number_slider, YCoordinate=number_slider_2, ZCoordinate=0)
srf4pt = _4PointSurface(CornerA=pt_3, CornerB=pt, CornerC=pt_2, CornerD=pt_4)
prop2d = Create2DProperty(ThicknessMm=Slider(500, range=0..1000), Mode=3)
evalsrf = EvaluateSurface(Surface=reparameterize(srf4pt), Point=pt_5)  # -> Point, Normal, UDirection, VDirection, Frame
support = CreateSupport(Point=evalsrf.Point, Plane=PlaneXY(0, 0, 0), x=False, xx=False, y=False, yy=False, z=True, zz=False)
support_2 = CreateSupport(Point=[pt_3, pt, pt_2, pt_4], Plane=PlaneXY(0, 0, 0), x=True, xx=False, y=True, yy=False, z=True, zz=False)
mem2d = Create2DMember(Brep=srf4pt, InclPoints=evalsrf.Point, _2DProperty=prop2d, MeshSize=0)
gravityload = CreateGravityLoad(LoadCase=1, ElementList="All", GravityFactor=Vector(0, 0, -1))
gsa = GSAModel(open)
mem2dedit = Edit2DMember(_2DMember=mem2d, _2DElementType="1", MeshWithOthers=True)  # -> _2DMember, MemberNumber, Brep, InclPoints, InclCurves, _2DProperty, MemberGroup, MemberType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
analyse = AnalyseModel(ModelS=gsa, GSAGeometry=[mem2dedit._2DMember, support_2, support], GSALoad=gravityload)
getgeo = GetModelGeometry(GSAModel=analyse, NodeFilterList="All", ElementFilterList="All", MemberFilterList="All", Mode=0)  # -> Nodes, _1DElements, _2DElements, _3DElements, _1DMembers, _2DMembers, _3DMembers
elem2dresults = _2DElementResults(
    GSAModel=analyse,
    LoadCase=1,
    ElementFilterList="All",
    Display=3,
    Mode=0,
    flayer=0,
    noDec=0,
    slider=True,
    val=50,
    valMax=100,
    valMin=0)  # -> Translation, Rotation, Mesh, Colours, Values
elem2dedit = Edit2DElement(_2DElement=getgeo._2DElements)  # -> _2DElement, Number, AnalysisMesh, _2DProperty, Group, ElementType, Offset, Name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
vlen = VectorLength(Vector=flatten(elem2dresults.Translation))
panel_3 = Panel(elem2dedit.ElementType)
cluster = Cluster(C=elem2dresults.Mesh)
sort = SortList(Keys=vlen)  # -> Keys, ValuesA
legend = Legend(Colour=elem2dresults.Colours, Tags=elem2dresults.Values, Rectangle=cluster, LegendType=1)
item = ListItem(List=reverse(sort.Keys), Index=0, Wrap=True)
galapagos = Galapagos(fitness=item, gene=[number_slider, number_slider_2])

# ==== cluster Cluster
io = IO(
    SofistikDocumentProperties_VersionMajor="2020",
    SofistikDocumentProperties_VersionMinor="8",
    SofistikDocumentProperties_VersionName="Rhino-Interface")
C = ClusterInput()
Y = UnitY(Factor="-1")
bbox = BoundingBox(Content=C, Plane=PlaneXY(0, 0, 0), UnionBox=True)  # -> Box, Box_2
project = Project(Geometry=bbox.Box, Plane=PlaneXY(0, 0, 0))  # -> Geometry, Transform
box_corners = BoxCorners(Box=project.Geometry)  # -> CornerA, CornerB, CornerC, CornerD, CornerE, CornerF, CornerG, CornerH
move = Move(Geometry=box_corners.CornerA, Motion=Y)  # -> Geometry, Transform
rectangle = Rectangle(Plane=move.Geometry, XSize="-1", YSize="-2", Radius=0)  # -> Rectangle, Length
R = ClusterOutput(rectangle.Rectangle)
