# Grasshopper definition CreateEdit3dPropElemAndMem.gh (Grasshopper 1.0.7)
# Copyright: Arup
# plug-ins: GSA

size = Slider(3, range=0..100)
movefact = Slider(0.5, range=0.1..0.9)
pt = ConstructPoint(XCoordinate=0, YCoordinate=0, ZCoordinate=0)
pt_2 = ConstructPoint(XCoordinate=size, YCoordinate=size, ZCoordinate=size)
multiplication = Multiplication(A=size, B=movefact)
vec = VectorXYZ(XComponent=multiplication, YComponent=multiplication, ZComponent=multiplication)  # -> Vector, Length
box = Box2Pt(PointA=pt, PointB=pt_2, Plane=PlaneXY(0, 0, 0))
material = CustomMaterial(
    ElasticModulus_MPa="18000",
    PoissonsRatio="0.3",
    Density_kg_m³="2400",
    Material_Type="Concrete",
    Stress_Unit="MPa",
    Density_Unit="kg/m³",
    Temperature_Unit="°C")
material_2 = CustomMaterial(
    ElasticModulus_MPa="8000",
    PoissonsRatio="0.15",
    Density_kg_m³="750",
    Material_Type="Timber",
    Stress_Unit="MPa",
    Density_Unit="kg/m³",
    Temperature_Unit="°C")
move = Move(Geometry=box, Motion=vec.Vector)  # -> Geometry, Transform
sunion = SolidUnion(Breps=[box, move.Geometry])
prop3d = Create3DProperty(Material=material)
mem3d = Create3DMember(Solid=sunion)
mem3dedit = Edit3DMember(
    Member3D=mem3d,
    Member3dNumber="6",
    _3DProperty=prop3d,
    MeshSizeInModelUnits="0.78",
    MeshWithOthers=Toggle(False),
    Member3dName="Member",
    Member3dGroup="99",
    Member3dColour=ColourSwatch(SwatchColor=RGB(0, 115, 255)),
    DummyMember=Toggle(True))  # -> Member3D, MemberNumber, SolidMesh, _3DProperty, MeshSizeInModelUnits, MeshWithOthers, MemberName, MemberGroup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
prop3dedit = Edit3DProperty(
    Prop3D=prop3d,
    Prop3dNumber="4",
    Material=material_2,
    Axis="1",
    Prop3dName="Timber",
    Prop3dColour=ColourSwatch(SwatchColor=RGB(255, 242, 0)))  # -> Prop3D, Prop2dNumber, Material, Axis, Prop3dName, Prop3dColour
model = CreateModel(GSAGeometryIn_m=mem3dedit.Member3D, ReMesh=True, Tolerance=0.01, Unit="m")
getgeo = GetModelGeometry(GSAModel=model, Mode=1, Unit="m")  # -> Nodes_m, _1DElements_m, _2DElements_m, _3DElements_m, _1DMembers_m, _2DMembers_m, _3DMembers_m
mem3dedit_2 = Edit3DMember(Member3D=getgeo._3DMembers_m)  # -> Member3D, MemberNumber, SolidMesh, _3DProperty, MeshSizeInModelUnits, MeshWithOthers, MemberName, MemberGroup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
prop3dedit_2 = Edit3DProperty(Prop3D=mem3dedit_2._3DProperty)  # -> Prop3D, Prop2dNumber, Material, Axis, Prop3dName, Prop3dColour
prop3dedit_3 = Edit3DProperty(Prop3D=prop3d)  # -> Prop3D, Prop2dNumber, Material, Axis, Prop3dName, Prop3dColour
elem3dedit = Edit3DElement(Element3D=getgeo._3DElements_m, _3DProperty=prop3dedit.Prop3D)  # -> Element3D, Number, AnalysisMesh, _3DProperty, Group, ElementType, Name, Colour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
lng = ListLength(List=mem3dedit_2.SolidMesh)
matprop = MaterialProperties(
    Material=prop3dedit_2.Material,
    DensityUnit="KilogramPerCubicMeter",
    StressUnit="Megapascal",
    TemperatureUnit="DegreeCelsius")  # -> ElasticModulus_MPa, PoissonsRatio, Density_kg_m³, ThermalExpansion_C_¹
matprop_2 = MaterialProperties(
    Material=prop3dedit_3.Material,
    DensityUnit="KilogramPerCubicMeter",
    StressUnit="Megapascal",
    TemperatureUnit="DegreeCelsius")  # -> ElasticModulus_MPa, PoissonsRatio, Density_kg_m³, ThermalExpansion_C_¹
prop3dedit_4 = Edit3DProperty(Prop3D=elem3dedit._3DProperty)  # -> Prop3D, Prop2dNumber, Material, Axis, Prop3dName, Prop3dColour
dcon = DeleteConsecutive(Set=elem3dedit.Group, Wrap=False)  # -> Set, Count
lng_2 = ListLength(List=elem3dedit.AnalysisMesh)

# ---- group: MemId
int = Integer(mem3dedit_2.MemberNumber)

# ---- group: MemCount
int_2 = Integer(lng)

# ---- group: MemName
txt = Text(mem3dedit_2.MemberName)

# ----
matprop_3 = MaterialProperties(
    Material=prop3dedit.Material,
    DensityUnit="KilogramPerCubicMeter",
    StressUnit="Megapascal",
    TemperatureUnit="DegreeCelsius")  # -> ElasticModulus_MPa, PoissonsRatio, Density_kg_m³, ThermalExpansion_C_¹
matprop_4 = MaterialProperties(
    Material=prop3dedit_4.Material,
    DensityUnit="KilogramPerCubicMeter",
    StressUnit="Megapascal",
    TemperatureUnit="DegreeCelsius")  # -> ElasticModulus_MPa, PoissonsRatio, Density_kg_m³, ThermalExpansion_C_¹
num = Number(matprop.ElasticModulus_MPa)
num_2 = Number(matprop.PoissonsRatio)
num_3 = Number(matprop.Density_kg_m³)
num_4 = Number(matprop.ThermalExpansion_C_¹)
int_3 = Integer(prop3dedit_4.Prop2dNumber)
num_5 = Number(matprop_3.ElasticModulus_MPa)
num_6 = Number(matprop_3.PoissonsRatio)
num_7 = Number(matprop_3.Density_kg_m³)
num_8 = Number(matprop_3.ThermalExpansion_C_¹)

# ---- group: MeshCount
int_4 = Integer(lng_2)

# ---- group: ElemGrp
int_5 = Integer(dcon.Set)

# ---- group: ElemMaterial
txt_2 = Text(prop3dedit_4.Prop3dName)

# ---- group: zero if all are true
equals = Equality(FirstNumber=mem3dedit_2.MeshSizeInModelUnits, SecondNumber=mem3dedit.MeshSizeInModelUnits)  # -> Equality, Inequality
equals_2 = Equality(FirstNumber=mem3dedit_2.MeshWithOthers, SecondNumber=mem3dedit.MeshWithOthers)  # -> Equality, Inequality
equals_3 = Equality(FirstNumber=mem3dedit_2.MemberGroup, SecondNumber=mem3dedit.MemberGroup)  # -> Equality, Inequality
equals_4 = Equality(FirstNumber=mem3dedit_2.DummyMember, SecondNumber=mem3dedit.DummyMember)  # -> Equality, Inequality
equals_5 = Equality(FirstNumber=num, SecondNumber=matprop_2.ElasticModulus_MPa)  # -> Equality, Inequality
equals_6 = Equality(FirstNumber=num_4, SecondNumber=matprop_2.ThermalExpansion_C_¹)  # -> Equality, Inequality
equals_7 = Equality(FirstNumber=num_2, SecondNumber=matprop_2.PoissonsRatio)  # -> Equality, Inequality
equals_8 = Equality(FirstNumber=num_3, SecondNumber=matprop_2.Density_kg_m³)  # -> Equality, Inequality
equals_9 = Equality(FirstNumber=prop3dedit_2.Axis, SecondNumber=prop3dedit_3.Axis)  # -> Equality, Inequality
ma = MassAddition(Input=flatten([equals_5.Inequality, equals_7.Inequality, equals_8.Inequality, equals_6.Inequality, equals_9.Inequality, equals.Inequality, equals_2.Inequality, equals_3.Inequality, equals_4.Inequality]))  # -> Result, PartialResults

# ----
num_9 = Number(matprop_4.ElasticModulus_MPa)
num_10 = Number(matprop_4.PoissonsRatio)
num_11 = Number(matprop_4.Density_kg_m³)
num_12 = Number(matprop_4.ThermalExpansion_C_¹)

# ---- group: zero if all are true
equals_10 = Equality(FirstNumber=int_3, SecondNumber=prop3dedit.Prop2dNumber)  # -> Equality, Inequality
equals_11 = Equality(FirstNumber=num_9, SecondNumber=num_5)  # -> Equality, Inequality
equals_12 = Equality(FirstNumber=num_12, SecondNumber=num_8)  # -> Equality, Inequality
equals_13 = Equality(FirstNumber=num_10, SecondNumber=num_6)  # -> Equality, Inequality
equals_14 = Equality(FirstNumber=num_11, SecondNumber=num_7)  # -> Equality, Inequality
equals_15 = Equality(FirstNumber=prop3dedit_4.Axis, SecondNumber=prop3dedit.Axis)  # -> Equality, Inequality
ma_2 = MassAddition(Input=[equals_10.Inequality, equals_11.Inequality, equals_13.Inequality, equals_14.Inequality, equals_12.Inequality, equals_15.Inequality])  # -> Result, PartialResults

# ---- group: EditMemTest
int_6 = Integer(ma.Result)

# ----
panel = Panel(int_6)

# ---- group: EditElemTest
int_7 = Integer(ma_2.Result)

# ----
panel_2 = Panel(int_7)
