# Grasshopper definition CreateGridPlane.gh (Grasshopper 1.0.7)
# plug-ins: GSA

xy = XYPlane(Origin=Point(0, 0, 0))

# ---- group: gps
gridplane = CreateGridPlane(Plane=xy, GridPlaneID="42", GridElevationInModelUnits=Slider(10, range=0..100), Name="test", Type="General")
