# Grasshopper definition CreateLoads.gh (Grasshopper 1.0.7)
# Copyright: Arup
# plug-ins: GSA

profile = CreateProfile(
    catalogueIndex=2,
    inclSS=False,
    lengthUnit="Centimeter",
    mode="Catalogue",
    Profile_type="Catalogue",
    Catalogue="British",
    Type="Parallel flange I sections(IPE) - EN10365:2017",
    Profile="BSI-IPE IPE100",
    typeIndex=248)
createlist = CreateList(Index="1", Name="Elements", Definition="all", Type="Element")
createlist_2 = CreateList(Index="1", Name="Members", Definition="all", Type="Member")
pt = ConstructPoint(XCoordinate=0, YCoordinate=0, ZCoordinate=0)
pt_2 = ConstructPoint(XCoordinate="1", YCoordinate=0, ZCoordinate=0)
mat = CreateMaterial(Material_type="Concrete", Design_Code="EC2-1-1", Grade="C30/37")
ln = Line(StartPoint=pt, EndPoint=pt_2)
section = CreateSection(Profile=profile, Basic_Offset="Centroid")
mem1d = Create1DMember(
    Curve=ln,
    Preview3dSection=False,
    x1=False,
    x2=False,
    xx1=False,
    xx2=False,
    y1=False,
    y2=False,
    yy1=False,
    yy2=False,
    z1=False,
    z2=False,
    zz1=False,
    zz2=False)
elem1d = Create1DElement(Line=ln, Preview3dSection=False)
loadcase = CreateLoadCase(CaseID="7", Name="Name", Type="LiveRoof")
lcinfo = LoadCaseInfo(LoadCase=loadcase)  # -> CaseID, Name, Type
beamload = CreateBeamLoad(
    LoadCase="1",
    Loadable1DObjects=[createlist, createlist_2, elem1d, mem1d, mat, section],
    Axis=0,
    Direction="z",
    Projected=False,
    Value_kN_m="1",
    Type="Uniform",
    Unit="kN/m")
beamthermalload = CreateBeamThermalLoad(LoadCase="1", Loadable1DObjects=elem1d, Value_C="1", Type="Uniform", Unit="°C")
int = Integer(lcinfo.CaseID)
txt = Text(lcinfo.Name)
txt_2 = Text(lcinfo.Type)
panel = Panel(int)
panel_2 = Panel(txt)
panel_3 = Panel(txt_2)
loadprop = LoadProperties(Load=beamthermalload, Force_Unit="kN", Length_Unit="m")  # -> LoadCase, Name, Definition, Axis, Direction, Projected, LoadValueOrFactorX_forceUnitAbbreviation_kN_forcePerLengthUnit_kN_m_forcePerAreaUnit_kN_m², LoadValueOrFactorY_forceUnitAbbreviation_kN_forcePerLengthUnit_kN_m_forcePerAreaUnit_kN_m²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
loadprop_2 = LoadProperties(Load=beamload, Force_Unit="kN", Length_Unit="m")  # -> LoadCase, Name, Definition, Axis, Direction, Projected, LoadValueOrFactorX_forceUnitAbbreviation_kN_forcePerLengthUnit_kN_m_forcePerAreaUnit_kN_m², LoadValueOrFactorY_forceUnitAbbreviation_kN_forcePerLengthUnit_kN_m_forcePerAreaUnit_kN_m²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
int_2 = Integer(loadprop.LoadCase)
txt_3 = Text(loadprop.LoadValueOrFactorX_forceUnitAbbreviation_kN_forcePerLengthUnit_kN_m_forcePerAreaUnit_kN_m²)
txt_4 = Text(loadprop_2.LoadValueOrFactorX_forceUnitAbbreviation_kN_forcePerLengthUnit_kN_m_forcePerAreaUnit_kN_m²)
int_3 = Integer(loadprop_2.LoadCase)
panel_4 = Panel(int_2)
panel_5 = Panel(txt_3)
panel_6 = Panel(int_3)
panel_7 = Panel(txt_4)
num = Number(loadprop.LoadValueOrFactorX_forceUnitAbbreviation_kN_forcePerLengthUnit_kN_m_forcePerAreaUnit_kN_m²)
num_2 = Number(loadprop_2.LoadValueOrFactorX_forceUnitAbbreviation_kN_forcePerLengthUnit_kN_m_forcePerAreaUnit_kN_m²)
equals = Equality(FirstNumber="1", SecondNumber=int_2)  # -> Equality, Inequality
equals_2 = Equality(FirstNumber="1", SecondNumber=int_3)  # -> Equality, Inequality
equals_3 = Equality(FirstNumber=num, SecondNumber="1")  # -> Equality, Inequality
equals_4 = Equality(FirstNumber=num_2, SecondNumber="1")  # -> Equality, Inequality
ma = MassAddition(Input=equals.Inequality)  # -> Result, PartialResults
ma_2 = MassAddition(Input=equals_2.Inequality)  # -> Result, PartialResults
ma_3 = MassAddition(Input=equals_3.Inequality)  # -> Result, PartialResults
ma_4 = MassAddition(Input=equals_4.Inequality)  # -> Result, PartialResults
equals_5 = Equality(FirstNumber=ma.Result, SecondNumber="0")  # -> Equality, Inequality
equals_6 = Equality(FirstNumber=ma_2.Result, SecondNumber="0")  # -> Equality, Inequality
equals_7 = Equality(FirstNumber=ma_3.Result, SecondNumber="0")  # -> Equality, Inequality
equals_8 = Equality(FirstNumber=ma_4.Result, SecondNumber="0")  # -> Equality, Inequality
ma_5 = MassAddition(Input=[equals_5.Inequality, equals_7.Inequality])  # -> Result, PartialResults
ma_6 = MassAddition(Input=[equals_6.Inequality, equals_8.Inequality])  # -> Result, PartialResults
equals_9 = Equality(FirstNumber=ma_5.Result, SecondNumber="0")  # -> Equality, Inequality
equals_10 = Equality(FirstNumber=ma_6.Result, SecondNumber="0")  # -> Equality, Inequality
bool = Boolean(equals_9.Equality)

# ---- group: BeamLoad
bool_2 = Boolean(equals_10.Equality)

# ----
panel_8 = Panel(bool)
panel_9 = Panel(bool_2)
