# Grasshopper definition Display2d.gh (Grasshopper 1.0.7)
# Copyright: Arup
# plug-ins: GSA

panel = Panel("https://github.com/arup-group/GSA-Grasshopper/raw/main/GsaGHTests/TestHelpers/Element2d_Simple.gwb")
c_script = CSharpScript(x=panel)  # -> A; inputs x: String
# ---------- c_script: C# usings ----------
using System.Linq;
# ---------- c_script: C# ----------
    string filePath = System.IO.Path.GetTempPath();
    string fileName = x.Split('/').Last();
    //create webclient and download example file:
    System.Net.WebClient webClient = new System.Net.WebClient();
    webClient.DownloadFile(
      x,
      filePath + fileName);

    A = filePath + fileName;
# ---------- end c_script ----------
open = OpenModel(FilenameAndPath=c_script)
getgeo = GetModelGeometry(GSAModel=open, Mode=1, Unit="m")  # -> NodesIn_m, _1DElementsIn_m, _2DElementsIn_m, _3DElementsIn_m, _1DMembersIn_m, _2DMembersIn_m, _3DMembersIn_m
move = Move(Geometry=getgeo._2DMembersIn_m, Motion=Vector(0, 0, 10))  # -> Geometry, Transform
geo = Geometry([getgeo._2DMembersIn_m, getgeo._2DElementsIn_m])
getres = GetResult(GSAModel=open, T="A", Case=1)
getres_2 = GetResult(GSAModel=open, T="A", Case=1)
getres_3 = GetResult(GSAModel=open, T="A", Case=1)
move_2 = Move(Geometry=geo, Motion=Vector(0, 0, 10))  # -> Geometry, Transform
move_3 = Move(Geometry=getgeo._2DElementsIn_m, Motion=Vector(0, 0, 10))  # -> Geometry, Transform
move_4 = Move(Geometry=move.Geometry, Motion=Vector(0, 0, 10))  # -> Geometry, Transform
move_5 = Move(Geometry=move_2.Geometry, Motion=Vector(0, 0, 10))  # -> Geometry, Transform
reactionforce = ReactionForceDiagrams(
    Result=getres,
    Annotation="true",
    SignificantDigits="2",
    Colour=ColourSwatch(SwatchColor=RGB(255, 255, 255)),
    Display=3,
    force="kN",
    length="mm",
    model="m",
    moment="kN·m",
    Component="Resolved |F|")  # -> DiagramLines, Annotations
loaddiagram = LoadDiagrams(GSAModel=open, Annotation=False, SignificantDigits=3, force="kN", length="mm", model="m", Case_ID="L1", Load_Type="All")  # -> DiagramLines, Annotations
contour2d = Contour2DResults(
    Result=getres_2,
    Display=3,
    Mode=0,
    flayer=0,
    force="kN/m",
    legend=True,
    legendScale=1,
    length="mm",
    model="m",
    moment="kN",
    noDec=0,
    Result_Type="Displacement",
    Component="Resolved |U|",
    slider=True,
    stress="MPa",
    val=250,
    valMax=1000,
    valMin=0)  # -> M, Colours, Values_mm
nodecontour = ContourNodeResults(
    Result=getres_2,
    Scalar=10,
    Display=3,
    Mode=0,
    force="kN",
    legend=True,
    legendScale=1,
    length="mm",
    model="m",
    moment="kN·m",
    noDec=0,
    Result_Type="Displacement",
    Component="Resolved |U|",
    slider=True,
    val=250,
    valMax=1000,
    valMin=0)  # -> P, Colours, Values_mm
deformedpreview3d = PreviewDeformed3DSections(Result=getres_3, ElementMemberFilterList="all", noDec=0, val=250, valMax=1000, valMin=0)  # -> Mesh, Outlines
preview3d = Preview3DSections(ElementMember1D2D=move_4.Geometry, Unit="m")  # -> AnalysisLayerMesh, AnalysisLayerOutlines, DesignLayerMesh, DesignLayerOutlines
preview3d_2 = Preview3DSections(ElementMember1D2D=move_3.Geometry, Unit="m")  # -> AnalysisLayerMesh, AnalysisLayerOutlines, DesignLayerMesh, DesignLayerOutlines
annotate_detailed = AnnotateDetailed(
    ElementMember=move_5.Geometry,
    Size="0.1",
    Colour=ColourSwatch(SwatchColor=RGB(255, 255, 255)),
    id=True,
    material=True,
    name=True,
    property=True,
    Type="TextTag 3D",
    text3d=True)  # -> Annotations, Position, Text
annotate_detailed_2 = AnnotateDetailed(
    ElementMember=move_2.Geometry,
    Size="1",
    Colour=ColourSwatch(SwatchColor=RGB(255, 255, 255)),
    id=True,
    material=True,
    name=True,
    property=True,
    Type="Regular Dot",
    text3d=False)  # -> Annotations, Position, Text
an = Annotate(NodeElementMemberLoadResultDiagram=getgeo._2DElementsIn_m, Colour=ColourSwatch(SwatchColor=RGB(255, 255, 255)))  # -> Annotations, Position, Text
meshresinfo = MeshResultInfo(M=contour2d.M)  # -> Mesh, Vertices, R
null = NullItem(Item=[loaddiagram.DiagramLines, loaddiagram.Annotations, reactionforce.DiagramLines, reactionforce.Annotations])  # -> flatten(NullFlags), InvalidFlags, Description
null_2 = NullItem(Item=[preview3d_2.AnalysisLayerMesh, preview3d_2.AnalysisLayerOutlines, preview3d.DesignLayerMesh, preview3d.DesignLayerOutlines, deformedpreview3d.Mesh, deformedpreview3d.Outlines])  # -> flatten(NullFlags), InvalidFlags, Description
null_3 = NullItem(Item=[nodecontour.Colours, nodecontour.Values_mm, contour2d.M, contour2d.Colours, contour2d.Values_mm, meshresinfo.Mesh, meshresinfo.Vertices, meshresinfo.R])  # -> flatten(NullFlags), InvalidFlags, Description
null_4 = NullItem(Item=[an.Annotations, an.Position, an.Text, annotate_detailed_2.Annotations, annotate_detailed_2.Position, annotate_detailed.Annotations, annotate_detailed.Position, annotate_detailed.Text])  # -> NullFlags, InvalidFlags, Description
ma = MassAddition(Input=null.NullFlags)  # -> Result, PartialResults
ma_2 = MassAddition(Input=null_2.NullFlags)  # -> Result, PartialResults
ma_3 = MassAddition(Input=null_3.NullFlags)  # -> Result, PartialResults
ma_4 = MassAddition(Input=null_4.NullFlags)  # -> Result, PartialResults
equals = Equality(FirstNumber=ma.Result, SecondNumber="0")  # -> Equality, Inequality
equals_2 = Equality(FirstNumber=ma_2.Result, SecondNumber="0")  # -> Equality, Inequality
equals_3 = Equality(FirstNumber=ma_3.Result, SecondNumber="0")  # -> Equality, Inequality
equals_4 = Equality(FirstNumber=ma_4.Result, SecondNumber="0")  # -> Equality, Inequality

# ---- group: Preview
bool = Boolean(equals_2.Equality)

# ---- group: Diagrams
bool_2 = Boolean(equals.Equality)

# ---- group: Results
bool_3 = Boolean(equals_3.Equality)

# ---- group: Annotate
bool_4 = Boolean(equals_4.Equality)

# ----
panel_2 = Panel(bool)
panel_3 = Panel(bool_2)
panel_4 = Panel(bool_3)
panel_5 = Panel(bool_4)
