# Grasshopper definition Elem1dResults.gh (Grasshopper 1.0.7)
# Copyright: Arup
# plug-ins: GSA

panel = Panel("https://samples.oasys-software.com/gsa/10.1/Training_General/TrGen_10.gwb")
c_script = CSharpScript(x=panel)  # -> A; inputs x: String
# ---------- c_script: C# usings ----------
using System.Linq;
# ---------- c_script: C# ----------
    string filePath = System.IO.Path.GetTempPath();
    string fileName = x.Split('/').Last();
    //create webclient and download example file:
    System.Net.WebClient webClient = new System.Net.WebClient();
    webClient.DownloadFile(
      x,
      filePath + fileName);

    A = filePath + fileName;
# ---------- end c_script ----------
open = OpenModel(FilenameAndPath=c_script, File="C:\Users\kristjan.nielsen\AppData\Local\Temp\TrGen_10.gwb")
analyse = AnalyseModel(ModelS=open, Analyse=True, ReMesh=True, Tolerance=0.05, Unit="m")
gsa = Model(analyse)
series = Series(Start="1", Step=1, Count="22")
selres = SelectResults(GSAModel=analyse, Type="AnalysisCase", Case_ID="A3")
selres_2 = SelectResults(GSAModel=gsa, Type="AnalysisCase", Case_ID="A2")
selres_3 = SelectResults(GSAModel=gsa, Type="AnalysisCase", Case_ID="A1")
selres_4 = SelectResults(GSAModel=gsa, Case=series, Type="AnalysisCase", Case_ID="A22")
item = ListItem(List=selres_4, Index=0, Wrap=True)
addition = Addition(A="7", B="2")
beamdisp = BeamDisplacements(Result=selres, ElementFilterList="5", IntermediatePoints=3, Unit="mm")  # -> TranslationsX_mm, TranslationsY_mm, TranslationsZ_mm, TranslationsXYZ_mm, RotationsXX_rad, RotationsYY_rad, RotationsZZ_rad, RotationsXYZ_rad
getgeo = GetModelGeometry(GSAModel=analyse, NodeFilterList="All", ElementFilterList="5", MemberFilterList="All", Mode=1, Unit="m")  # -> Nodes_m, _1DElements_m, _2DElements_m, _3DElements_m, _1DMembers_m, _2DMembers_m, _3DMembers_m
contourelem1d = _1DContourResults(
    Result=selres,
    ElementFilterList="5",
    IntermediatePoints="3",
    Scale=10,
    Display=3,
    Mode=0,
    energy="MJ",
    force="kN",
    legend=True,
    legendScale=1,
    length="mm",
    model="m",
    moment="kN·m",
    noDec=0,
    Result_Type="Displacement",
    Component="Resolved |U|",
    slider=True,
    val=750,
    valMax=1000,
    valMin=0)  # -> Line, Colours, Values_mm
beamforces = BeamForcesAndMoments(Result=selres_2, ElementFilterList="All", IntermediatePoints="7", Force_Unit="kN", Moment_Unit="kN·m")  # -> ForceX_kN, ForceY_kN, ForceZ_kN, ForceXYZ_kN, MomentXX_kN_m, MomentYY_kN_m, MomentZZ_kN_m, MomentXXYYZZ_kN_m
contourelem1d_2 = _1DContourResults(
    Result=selres_2,
    ElementFilterList="9",
    IntermediatePoints="7",
    Scale=10,
    Display=0,
    Mode=1,
    energy="MJ",
    force="kN",
    legend=False,
    legendScale=1,
    length="mm",
    model="m",
    moment="kN·m",
    noDec=0,
    Result_Type="Force",
    Component="Axial Force Fx",
    slider=False,
    val=0,
    valMax=1000,
    valMin=0)  # -> Line, Colours, LegendValues_kN
contourelem1d_3 = _1DContourResults(
    Result=selres_2,
    ElementFilterList="9",
    IntermediatePoints="7",
    Scale=10,
    Display=5,
    Mode=1,
    energy="MJ",
    force="kN",
    legend=True,
    legendScale=1,
    length="mm",
    model="m",
    moment="kN·m",
    noDec=0,
    Result_Type="Force",
    Component="Moment Myy",
    slider=False,
    val=0,
    valMax=1000,
    valMin=0)  # -> Line, Colours, LegendValues_kN_m
path = ConstructPath(Indices=["2", "0", "9"])
strainenergy = BeamStrainEnergyDensity(Result=selres_4, ElementFilterList="1363", IntermediatePoints="3", checked=False, Energy_Unit="MJ")  # -> flatten(StrainEnergyDensity_MJ_m³)
series_2 = Series(Start=0, Step=1, Count=addition)
strainenergy_2 = BeamStrainEnergyDensity(Result=selres_3, ElementFilterList="All", checked=True, Energy_Unit="J")  # -> flatten(StrainEnergyDensity_J_m³)
contourelem1d_4 = _1DContourResults(
    Result=item,
    ElementFilterList="1363",
    IntermediatePoints="3",
    Scale=10,
    Display=0,
    Mode=2,
    energy="MJ",
    force="kN",
    legend=False,
    legendScale=1,
    length="mm",
    model="m",
    moment="kN·m",
    noDec=0,
    Result_Type="Strain Energy",
    Component="Intermediate Pts",
    slider=False,
    val=0,
    valMax=1000,
    valMin=0)  # -> Line, Colours, LegendValues_MJ
line = Line(contourelem1d.Line)
divide = DivideCurve(Curve=getgeo._1DElements_m, Count="4", Kinks=False)  # -> Points, Tangents, Parameters
end = EndPoints(Curve=line)  # -> Start, End
e1dresinfo = Elem1dContourInfo(Line=contourelem1d_2.Line)  # -> Line, V1, V2
e1dresinfo_2 = Elem1dContourInfo(Line=contourelem1d_3.Line)  # -> Line, V1, V2
e1dresinfo_3 = Elem1dContourInfo(Line=contourelem1d_4.Line)  # -> Line, V1, V2
item_2 = ListItem(List=end.Start, Index=0, Wrap=True)
end_2 = EndPoints(Curve=e1dresinfo_2.Line)  # -> Start, End
ins = InsertItems(List=end.End, Item=item_2, Indices="0", Wrap=True)
item_3 = ListItem(List=e1dresinfo.V1, Index=0, Wrap=True)
item_4 = ListItem(List=e1dresinfo_2.V1, Index=0, Wrap=True)
item_5 = TreeItem(Tree=beamforces.ForceXYZ_kN, Path=path, Index=series_2, Wrap=True)
item_6 = TreeItem(Tree=beamforces.ForceX_kN, Path=path, Index=series_2, Wrap=True)
item_7 = TreeItem(Tree=beamforces.MomentXX_kN_m, Path=path, Index=series_2, Wrap=True)
item_8 = TreeItem(Tree=beamforces.ForceY_kN, Path=path, Index=series_2, Wrap=True)
item_9 = TreeItem(Tree=beamforces.ForceZ_kN, Path=path, Index=series_2, Wrap=True)
item_10 = TreeItem(Tree=beamforces.MomentYY_kN_m, Path=path, Index=series_2, Wrap=True)
item_11 = TreeItem(Tree=beamforces.MomentZZ_kN_m, Path=path, Index=series_2, Wrap=True)
item_12 = TreeItem(Tree=beamforces.MomentXXYYZZ_kN_m, Path=path, Index=series_2, Wrap=True)
item_13 = ListItem(List=e1dresinfo_3.V1, Index=0, Wrap=True)
tag = TextTag(Location=end_2.Start, Text=e1dresinfo_2.V1)
dist = Distance(PointA=divide.Points, PointB=ins)

# ---- group: Scaled to deformed shape
num = Number(beamdisp.TranslationsXYZ_mm)
multiplication = Multiplication(A=num, B="750")  # -> flatten(Result)

# ---- group: Fx
num_2 = Number(item_6)

# ---- group: Fy
num_3 = Number(item_8)

# ---- group: Fz
num_4 = Number(item_9)

# ---- group: Fyz
num_5 = Number(item_5)

# ---- group: Ux
num_6 = Number(beamdisp.TranslationsX_mm)

# ---- group: Uy
num_7 = Number(beamdisp.TranslationsY_mm)

# ---- group: Uz
num_8 = Number(beamdisp.TranslationsZ_mm)

# ---- group: U
num_9 = Number(beamdisp.TranslationsXYZ_mm)

# ---- group: Mxx
num_10 = Number(item_7)

# ---- group: Myy
num_11 = Number(item_10)

# ---- group: Mzz
num_12 = Number(item_11)

# ---- group: Rxx
num_13 = Number(beamdisp.RotationsXX_rad)

# ---- group: Myz
num_14 = Number(item_12)

# ---- group: Ryy
num_15 = Number(beamdisp.RotationsYY_rad)

# ---- group: Scaled to mm
multiplication_2 = Multiplication(A=dist, B="1000")

# ---- group: Rzz
num_16 = Number(beamdisp.RotationsZZ_rad)

# ---- group: R
num_17 = Number(beamdisp.RotationsXYZ_rad)

# ----
ins_2 = InsertItems(List=e1dresinfo.V2, Item=item_3, Indices="0", Wrap=True)
ins_3 = InsertItems(List=e1dresinfo_2.V2, Item=item_4, Indices="0", Wrap=True)
ins_4 = InsertItems(List=e1dresinfo_3.V2, Item=item_13, Indices="0", Wrap=True)

# ---- group: AvgStrainEnergyDensity
num_18 = Number(strainenergy_2)

# ---- group: StrainEnergyDensity
num_19 = Number(strainenergy)

# ----
panel_2 = Panel(num_2)
panel_3 = Panel(num_3)
panel_4 = Panel(num_4)
panel_5 = Panel(num_5)
panel_6 = Panel(num_6)
panel_7 = Panel(num_7)
panel_8 = Panel(num_8)
panel_9 = Panel(num_9)
panel_10 = Panel(num_10)
panel_11 = Panel(num_12)
panel_12 = Panel(num_13)
panel_13 = Panel(num_14)
panel_14 = Panel(num_15)
panel_15 = Panel(num_16)
panel_16 = Panel(num_17)
panel_17 = Panel(num_19)
panel_18 = Panel(num_18)

# ---- group: MyyContour
num_20 = Number(ins_3)

# ---- group: FxContour
num_21 = Number(ins_2)

# ---- group: ScaledResults
num_22 = Number(multiplication)

# ---- group: ScaledContours
num_23 = Number(multiplication_2)

# ---- group: StrainEnergyDensityContour
num_24 = Number(ins_4)

# ----
panel_19 = Panel(num_11)
panel_20 = Panel(num_22)
panel_21 = Panel(num_23)
panel_22 = Panel(num_20)
panel_23 = Panel(num_24)
