# Grasshopper definition GetExistingMaterialInNewModel.gh (Grasshopper 1.0.7)
# plug-ins: GSA

panel = Panel("https://samples.oasys-software.com/gsa/10.1/Steel/Steel_Design_Simple.gwb")
c_script = CSharpScript(x=panel)  # -> A; inputs x: String
# ---------- c_script: C# ----------
    string fileName = System.IO.Path.GetTempPath();

    //create webclient and download example file:
    System.Net.WebClient webClient = new System.Net.WebClient();
    webClient.DownloadFile(
      x,
      fileName + "Steel_Design_Simple.gwb");

    A = fileName + "Steel_Design_Simple.gwb";
# ---------- end c_script ----------
open = OpenModel(FilenameAndPath=c_script, File="C:\Users\kristjan.nielsen\AppData\Local\Temp\Steel_Design_Simple.gwb")
profile = CreateProfile(
    NumberOfInputs=0,
    catalogueIndex=3,
    inclSS=False,
    lengthUnit="Centimeter",
    mode="Catalogue",
    Profile_type="Catalogue",
    Catalogue="Europrofile",
    Type="EP HE beams",
    Profile="HE HE180.B",
    typeIndex=27)
getmats = GetModelMaterials(GSAModel=open)  # -> Steel, Concrete, PMat, Aluminium, Timber, Glass, Fabric, Custom
section = CreateSection(Profile=profile, Material=getmats.Steel, Basic_Offset="Centroid")
model = CreateModel(Properties=section, ReMesh=True, Tolerance=0.01, Unit="m")
getmats_2 = GetModelMaterials(GSAModel=model)  # -> Steel, Concrete, PMat, Aluminium, Timber, Glass, Fabric, Custom
matprop = MaterialProperties(Material=getmats_2.Steel, DensityUnit="KilogramPerCubicMeter", StressUnit="Megapascal", TemperatureUnit="DegreeCelsius")  # -> ElasticModulus_MPa, PoissonsRatio, Density_kg_m³, ThermalExpansion_C_¹
matprop_2 = MaterialProperties(Material=getmats.Steel, DensityUnit="KilogramPerCubicMeter", StressUnit="Megapascal", TemperatureUnit="DegreeCelsius")  # -> ElasticModulus_MPa, PoissonsRatio, Density_kg_m³, ThermalExpansion_C_¹
num = Number(matprop.ElasticModulus_MPa)
num_2 = Number(matprop_2.ElasticModulus_MPa)
num_3 = Number(matprop.Density_kg_m³)
num_4 = Number(matprop.PoissonsRatio)
num_5 = Number(matprop_2.Density_kg_m³)
num_6 = Number(matprop_2.PoissonsRatio)
num_7 = Number(matprop.ThermalExpansion_C_¹)
num_8 = Number(matprop_2.ThermalExpansion_C_¹)
equals = Equality(FirstNumber=num, SecondNumber=num_2)  # -> Equality, Inequality
equals_2 = Equality(FirstNumber=num_3, SecondNumber=num_5)  # -> Equality, Inequality
equals_3 = Equality(FirstNumber=num_4, SecondNumber=num_6)  # -> Equality, Inequality
equals_4 = Equality(FirstNumber=num_7, SecondNumber=num_8)  # -> Equality, Inequality
ma = MassAddition(Input=[equals.Inequality, equals_3.Inequality, equals_2.Inequality, equals_4.Inequality])  # -> Result, PartialResults

# ---- group: MaterialIsEqual
int = Integer(ma.Result)
