# Grasshopper definition GetResultsAndResultsInfo.gh (Grasshopper 1.0.7)
# plug-ins: GSA

panel = Panel("https://samples.oasys-software.com/gsa/10.1/Steel/Steel_Design_Simple.gwb")
c_script = CSharpScript(x=panel)  # -> A; inputs x: String
# ---------- c_script: C# ----------
    string fileName = System.IO.Path.GetTempPath();

    //create webclient and download example file:
    System.Net.WebClient webClient = new System.Net.WebClient();
    webClient.DownloadFile(
      x,
      fileName + "Steel_Design_Simple.gwb");

    A = fileName + "Steel_Design_Simple.gwb";
# ---------- end c_script ----------
open = OpenModel(FilenameAndPath=c_script, File="C:\Users\kristjan.nielsen\AppData\Local\Temp\Steel_Design_Simple.gwb")
save = SaveGSAModel(
    GSAModel=open,
    Save=False,
    FileAndPath="C:\Users\kristjan.nielsen\Desktop\test.gwb",
    File="C:\Users\kristjan.nielsen\Desktop\test.gwb")
getcases = GetResultCases(GSAModel=open)  # -> T, Case, Permutation
getres = GetResults(GSAModel=open, T="C", Case="1")
beamforces = BeamForcesAndMoments(Result=getres, ElementFilterList="All", IntermediatePoints=3, Force_Unit="kN", Moment_Unit="N·m")  # -> ForceX_kN, ForceY_kN, ForceZ_kN, ForceXYZ_kN, MomentXX_N_m, MomentYY_N_m, MomentZZ_N_m, MomentXXYYZZ_N_m

# ---- group: Types
txt = Text(getcases.T)

# ---- group: CaseIDs
int = Integer(getcases.Case)

# ---- group: Permutations
int_2 = Integer(getcases.Permutation)

# ---- group: Myy
num = Number(beamforces.MomentYY_N_m)

# ----
panel_2 = Panel(int)
panel_3 = Panel(txt)
panel_4 = Panel(num)
panel_5 = Panel(int_2)
