# Grasshopper definition GlobalPerformance_Buckling.gh (Grasshopper 1.0.7)
# Copyright: Arup
# plug-ins: GSA

panel = Panel("https://samples.oasys-software.com/gsa/10.1/Buckling/Archd.gwb")
c_script = CSharpScript(x=panel)  # -> A; inputs x: String
# ---------- c_script: C# usings ----------
using System.Linq;
# ---------- c_script: C# ----------
    string filePath = System.IO.Path.GetTempPath();
    string fileName = x.Split('/').Last();
    //create webclient and download example file:
    System.Net.WebClient webClient = new System.Net.WebClient();
    webClient.DownloadFile(
      x,
      filePath + fileName);

    A = filePath + fileName;
# ---------- end c_script ----------
open = OpenModel(FilenameAndPath=c_script, File="C:\Users\kristjan.nielsen\AppData\Local\Temp\Archd.gwb")
panel_2 = Panel("""1
2
3""")
selres = SelectResults(GSAModel=open, Case=panel_2, Type="AnalysisCase", Case_ID="A3")
globalperformance = GlobalPerformanceResults(Result=selres, Mass_Unit="t", Inertia_Unit="m⁴", Stiffness_Unit="kN/m")  # -> EffectiveMassX_t, EffectiveMassY_t, EffectiveMassZ_t, EffectiveMassXYZ_t, EffectiveInertiaX_m⁴, EffectiveInertiaY_m⁴, EffectiveInertiaZ_m⁴, EffectiveInertiaXYZ_m⁴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

# ---- group: Modes
int = Integer(globalperformance.Mode)

# ---- group: LoadFactors
num = Number(globalperformance.LoadFactor)

# ----
panel_3 = Panel(int)
panel_4 = Panel(num)
