# Grasshopper definition GlobalPerformance_Modal.gh (Grasshopper 1.0.7)
# Copyright: Arup
# plug-ins: GSA

panel = Panel("https://samples.oasys-software.com/gsa/10.1/Dynamic/Harmonic_2D_Model.gwb")
c_script = CSharpScript(x=panel)  # -> A; inputs x: String
# ---------- c_script: C# usings ----------
using System.Linq;
# ---------- c_script: C# ----------
    string filePath = System.IO.Path.GetTempPath();
    string fileName = x.Split('/').Last();
    //create webclient and download example file:
    System.Net.WebClient webClient = new System.Net.WebClient();
    webClient.DownloadFile(
      x,
      filePath + fileName);

    A = filePath + fileName;
# ---------- end c_script ----------
open = OpenModel(FilenameAndPath=c_script, File="C:\Users\kristjan.nielsen\AppData\Local\Temp\Harmonic_2D_Model.gwb")
analyse = AnalyseModel(ModelS=open, Analyse=True, ReMesh=False, Tolerance=0.05, Unit="m")
panel_2 = Panel("""1
2
4
5""")
selres = SelectResults(GSAModel=analyse, Case=panel_2, Type="AnalysisCase", Case_ID="A5")
globalperformance = GlobalPerformanceResults(Result=selres, Mass_Unit="t", Inertia_Unit="m⁴", Stiffness_Unit="kN/m")  # -> EffectiveMassX_t, EffectiveMassY_t, EffectiveMassZ_t, EffectiveMassXYZ_t, EffectiveInertiaX_m⁴, EffectiveInertiaY_m⁴, EffectiveInertiaZ_m⁴, EffectiveInertiaXYZ_m⁴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

# ---- group: EffectiveMassesZ
num = Number(globalperformance.EffectiveMassZ_t)

# ---- group: Modes
int = Integer(globalperformance.Mode)

# ---- group: ModalMasses
num_2 = Number(globalperformance.ModalMass_t)

# ---- group: ModalStiffnesses
num_3 = Number(globalperformance.ModalStiffness_kN_m)

# ---- group: Frequencies
num_4 = Number(globalperformance.Frequency_Hz)

# ----
panel_3 = Panel(num)
panel_4 = Panel(int)
panel_5 = Panel(num_2)
panel_6 = Panel(num_3)
panel_7 = Panel(num_4)
