# Grasshopper definition GridLoadPolyline.gh (Grasshopper 1.0.7)
# Copyright: Arup
# plug-ins: GSA

pt = ConstructPoint(XCoordinate="1", YCoordinate="1", ZCoordinate=0)
pt_2 = ConstructPoint(XCoordinate="2", YCoordinate="1", ZCoordinate=0)
pt_3 = ConstructPoint(XCoordinate="2", YCoordinate="3", ZCoordinate=0)
pt_4 = ConstructPoint(XCoordinate="3", YCoordinate="4", ZCoordinate=0)
pline = PolyLine(Vertices=[pt, pt_2, pt_3, pt_4], Closed=False)
lineload = CreateGridLineLoad(LoadCase=1, PolyLine=pline, Direction="z", Axis=0, Projected=False, ValueStart_kN_m="-5", Unit="kN/m")
model = CreateModel(Load=lineload, ReMesh=True, Tolerance=0.01, Unit="m")
getloads = GetModelLoads(GSAModel=model, Unit="m")  # -> GravityLoads, NodeLoads, BeamLoads, FaceLoads, GridPointLoads_m, GridLineLoads_m, GridAreaLoads_m, GridPlaneSurfaces_m
loadprop = LoadProperties(Load=getloads.GridLineLoads_m, Force_Unit="kN", Length_Unit="m")  # -> LC, Na, Def, Ax, Di, Pj, V1, V2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
crv = Curve(loadprop.Def)
crv_2 = Curve(getloads.GridLineLoads_m)
