# Grasshopper definition LoadsFromReferenceObjects.gh (Grasshopper 1.0.7)
# plug-ins: GSA

# Prop2d
number_slider = Slider(15, range=0..100)
# Member1d
number_slider_2 = Slider(15, range=0..100)
# Element1d
number_slider_3 = Slider(15, range=0..100)
# Section
panel = Panel("15")
profile = CreateProfile(
    Depth_cm=panel,
    Width_cm=panel,
    catalogueIndex=-1,
    inclSS=False,
    lengthUnit="Centimeter",
    mode="Other",
    Profile_type="Rectangle",
    Measure="cm",
    typeIndex=-1)
pt = ConstructPoint(XCoordinate=0, YCoordinate=0, ZCoordinate=0)
pt_2 = ConstructPoint(XCoordinate=0, YCoordinate=number_slider_2, ZCoordinate=0)
# Member2d
pt_3 = ConstructPoint(XCoordinate=0, YCoordinate=0, ZCoordinate=0)
pt_4 = ConstructPoint(XCoordinate=0, YCoordinate=number_slider, ZCoordinate=0)
pt_5 = ConstructPoint(XCoordinate=number_slider, YCoordinate=number_slider, ZCoordinate=0)
pt_6 = ConstructPoint(XCoordinate=number_slider, YCoordinate=0, ZCoordinate=0)
pt_7 = ConstructPoint(XCoordinate=0, YCoordinate=0, ZCoordinate=0)
pt_8 = ConstructPoint(XCoordinate=0, YCoordinate=number_slider_3, ZCoordinate=0)
prop2d = Create2DProperty(Thickness_cm="15", Type="Shell", Unit="cm")
# Element2d
mplane = MeshPlane(Boundary={Plane=PlaneXY(0, 0, 0), Size=Domain2(u=-10..10, v=-10..10)}, WidthCount=10, HeightCount=10)  # -> Mesh, Area
pt_9 = ConstructPoint(XCoordinate="0.7689", YCoordinate="0.7689", ZCoordinate=0)
section = CreateSection(Profile=profile, Basic_Offset="Centroid")
pt_10 = ConstructPoint(XCoordinate="0.23456", YCoordinate="0.23456", ZCoordinate=0)
pt_11 = ConstructPoint(XCoordinate="0.7689", YCoordinate="0.23456", ZCoordinate=0)
prop2d_2 = Create2DProperty(Thickness_cm="15", Type="Shell", Unit="cm")
pt_12 = ConstructPoint(XCoordinate="0.23456", YCoordinate="0.7689", ZCoordinate=0)
ln = Line(StartPoint=pt, EndPoint=pt_2)
ln_2 = Line(StartPoint=pt_7, EndPoint=pt_8)
srf4pt = _4PointSurface(CornerA=pt_3, CornerB=pt_4, CornerC=pt_5, CornerD=pt_6)
elem1d = Create1DElement(Line=ln_2, Preview3dSection=False)
elem2d = Create2DElement(Mesh=mplane.Mesh, Prop2D=prop2d, Preview3dSection=False)
sectionedit = EditSection(Section=section, SectionNumber="7")  # -> Section, SectionNumber, SectionProfile, Material, BasicOffset, AddOffsetY_cm, AddOffsetZ_cm, SectionModifier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
mem1d = Create1DMember(
    Curve=ln,
    Section=sectionedit.Section,
    MeshSizeInModelUnits=Slider(0.5, range=0..1),
    Preview3dSection=False,
    x1=False,
    x2=False,
    xx1=False,
    xx2=False,
    y1=False,
    y2=False,
    yy1=False,
    yy2=False,
    z1=False,
    z2=False,
    zz1=False,
    zz2=False)
# Gravity
pb = Section(sectionedit.Section)
pb_2 = Section(pb)
e2d = Element2D(elem2d)
e2d_2 = Element2D(e2d)
m1d = Member1D(mem1d)
m1d_2 = Member1D(m1d)
prop2dedit = Edit2DProperty(PA=prop2d_2, ID="19", LengthUnit="Centimeter", ReferenceEdge=0, SupportType=0)  # -> PA, ID, Na, Co, Ax, Ty, Mat, Th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
pa = Prop2D(prop2dedit.PA)
# GridSurface
pa_2 = Prop2D(pa)
series = Series(Start="1", Step=1, Count="6")
series_2 = Series(Start="1", Step=1, Count="6")
mem2d = Create2DMember(Brep=srf4pt, Prop2D=prop2dedit.PA)
elem1dedit = Edit1DElement(Element1D=elem1d, Number="42", Preview3dSection=False)  # -> Element1D, Number, Line, Section, Group, Type, Offset, StartRelease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
e1d = Element1D(elem1dedit.Element1D)
e1d_2 = Element1D(e1d)
panel_2 = Panel("""1
15 to 31 not 27""")

# ---- group: "Old" way
beamload = CreateBeamLoad(
    LoadCase=1,
    ElementList="42",
    Axis=0,
    Direction="z",
    Projected=False,
    ValueStart_kN_m=Slider(15, range=0..100),
    ValueEnd_kN_m=Slider(27, range=0..100),
    Type="Linear",
    Unit="kN/m")
model = CreateModel(GSAGeometryIn_m=elem1dedit.Element1D, Load=beamload, ReMesh=True, Tolerance=0.05, Unit="m")
getloads = GetModelLoads(GSAModel=model, Unit="m")  # -> LC, Gr, No, Be, Fa, Pt, Ln, Ar, GPS
getgeo = GetModelGeometry(GSAModel=model, NodeFilterList="All", ElementFilterList="All", MemberFilterList="All", Mode=1, Unit="m")  # -> Nodes_m, _1DElements_m, _2DElements_m, _3DElements_m, _1DMembers_m, _2DMembers_m, _3DMembers_m
loadprop = LoadProperties(Load=getloads.Be, Force_Unit="kN", Length_Unit="m")  # -> LoadCase, Name, ElementsNodesDefinition, Axis, Direction, Projected, LoadValueOrFactorX_forceUnitAbbreviation_kN_forcePerLengthUnit_kN_m_forcePerAreaUnit_kN_m², LoadValueOrFactorY_forceUnitAbbreviation_kN_forcePerLengthUnit_kN_m_forcePerAreaUnit_kN_m²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
int = Integer(getgeo._1DElements_m)
int_2 = Integer(loadprop.ElementsNodesDefinition)

# ----
beamload_2 = CreateBeamLoad(
    LoadCase=1,
    ElementList=sectionedit.Section,
    Axis=0,
    Direction="z",
    Projected=False,
    Value_kN_m=Slider(15, range=0..100),
    Type="Uniform",
    Unit="kN/m")
faceload = CreateFaceLoad(
    LoadCase=1,
    ElementList=prop2dedit.PA,
    Axis=-1,
    Direction="z",
    Projected=False,
    Value_kN_m²=Slider(5, range=0..10),
    Type="Uniform",
    Unit="kN/m²")
beamload_3 = CreateBeamLoad(
    LoadCase=1,
    ElementList=mem1d,
    Axis=0,
    Direction="z",
    Projected=False,
    Value_kN_m=Slider(15, range=0..100),
    Type="Uniform",
    Unit="kN/m")
faceload_2 = CreateFaceLoad(
    LoadCase=1,
    ElementList=elem2d,
    Axis=-1,
    Direction="z",
    Projected=False,
    Value1_kN_m²=Slider(4, range=0..10),
    Value2_kN_m²=Slider(4, range=0..10),
    Value3_kN_m²=Slider(4, range=0..10),
    Value4_kN_m²=Slider(4, range=0..10),
    Type="Variable",
    Unit="kN/m²")
m2d = Member2D(mem2d)
m2d_2 = Member2D(m2d)
brep = Brep(m2d_2)
evalsrf = EvaluateSurface(Surface=reparameterize(brep), Point=pt_9)  # -> Point, Normal, UDirection, VDirection, Frame
evalsrf_2 = EvaluateSurface(Surface=reparameterize(brep), Point=pt_10)  # -> Point, Normal, UDirection, VDirection, Frame
evalsrf_3 = EvaluateSurface(Surface=reparameterize(brep), Point=pt_11)  # -> Point, Normal, UDirection, VDirection, Frame
evalsrf_4 = EvaluateSurface(Surface=reparameterize(brep), Point=pt_12)  # -> Point, Normal, UDirection, VDirection, Frame
m2d_3 = Member2D(m2d)
m2d_4 = Member2D(m2d_3)
faceload_3 = CreateFaceLoad(
    LoadCase=1,
    ElementList=m2d,
    Axis=-1,
    Direction="z",
    Projected=False,
    Value_kN_m²=Slider(5, range=0..10),
    Type="Uniform",
    Unit="kN/m²")
entwine = Entwine(Branch00=pb_2, Branch01=pa_2, Branch02=e1d_2, Branch03=e2d_2, Branch04=m1d_2, Branch05=m2d_4, FlattenInputs=True)
entwine_2 = Entwine(
    Branch00=pb,
    Branch01=pa,
    Branch02=e1d,
    Branch03=e2d,
    Branch04=m1d,
    Branch05=m2d_3,
    Branch06="all not(PB4)",
    FlattenInputs=True)
panel_3 = Panel("""-4
-5""")
panel_4 = Panel("""x
y""")
gridsurface = CreateGridSurface(GridSurfaceID=graft(series), ElementList=entwine, SpanDirection=0, Type="1D, One-way span")  # -> flatten(GridSurface)
pt_13 = Point([evalsrf.Point, evalsrf_2.Point, evalsrf_3.Point, evalsrf_4.Point])
gravityload = CreateGravityLoad(LoadCase=graft(series_2), ElementList=entwine_2, GravityFactor=Vector(0, 0, -1))  # -> flatten(GravityLoad)
model_2 = CreateModel(GSAGeometryIn_m=elem2d, Load=faceload_2, ReMesh=True, Tolerance=0.05, Unit="m")
beamload_4 = CreateBeamLoad(
    LoadCase=1,
    ElementList=elem1dedit.Element1D,
    Axis=0,
    Direction="z",
    Projected=False,
    ValueStart_kN_m=Slider(15, range=0..100),
    ValueEnd_kN_m=Slider(27, range=0..100),
    Type="Linear",
    Unit="kN/m")
model_3 = CreateModel(GSAGeometryIn_m=mem1d, Load=beamload_2, ReMesh=True, Tolerance=0.05, Unit="m")
model_4 = CreateModel(GSAGeometryIn_m=mem1d, Load=beamload_3, ReMesh=True, Tolerance=0.05, Unit="m")
model_5 = CreateModel(GSAGeometryIn_m=m2d, Load=faceload_3, ReMesh=True, Tolerance=0.05, Unit="m")
model_6 = CreateModel(GSAGeometryIn_m=m2d, Load=faceload, ReMesh=True, Tolerance=0.05, Unit="m")
nodeload = CreateNodeLoad(
    LoadCase="4",
    NodeList=graft(panel_2),
    Name="Wind X",
    Direction=panel_4,
    Value_kN=graft(panel_3),
    Type="Node Force",
    Unit="kN")  # -> flatten(NodeLoad)
areaload = CreateGridAreaLoad(
    LoadCase=1,
    GridPlaneSurface=gridsurface,
    Direction="z",
    Axis=0,
    Projected=False,
    Value_kN_m²=Slider(5, range=0..10),
    ExpansionChanged=False,
    Mode=0,
    Unit="kN/m²")
mem2dedit = Edit2DMember(Member2D=m2d_2, InclPoints=pt_13)  # -> Member2D, MemberNumber, Brep, InclPoints, InclCurves, _2DProperty, MemberGroup, MemberType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
nodeload_2 = CreateNodeLoad(LoadCase=1, NodeList=evalsrf.Point, Direction="z", Value_kN=Slider(5, range=0..10), Type="Node Force", Unit="kN")
nodeload_3 = CreateNodeLoad(LoadCase=1, NodeList=evalsrf_4.Point, Direction="z", Value_mm=Slider(35, range=0..100), Type="Settlement", Unit="mm")
model_7 = CreateModel(
    Properties=[pb_2, pa_2],
    GSAGeometryIn_m=[e1d_2, e2d_2, m2d_4, m1d_2],
    Load=areaload,
    ReMesh=True,
    Tolerance=0.05,
    Unit="m")
nodeload_4 = CreateNodeLoad(LoadCase=1, NodeList=evalsrf_2.Point, Direction="xx", Value_kN_m=Slider(6, range=0..10), Type="Node Moment", Unit="kN·m")
nodeload_5 = CreateNodeLoad(LoadCase=1, NodeList=evalsrf_3.Point, Direction="z", Value_mm=Slider(12, range=0..100), Type="Applied Displ", Unit="mm")
model_8 = CreateModel(Properties=[pb, pa], GSAGeometryIn_m=[e1d, e2d, m2d_3, m1d], Load=gravityload, ReMesh=True, Tolerance=0.05, Unit="m")
getgeo_2 = GetModelGeometry(GSAModel=model_2, NodeFilterList="All", ElementFilterList="All", MemberFilterList="All", Mode=1, Unit="m")  # -> Nodes_m, _1DElements_m, _2DElements_m, _3DElements_m, _1DMembers_m, _2DMembers_m, _3DMembers_m
getloads_2 = GetModelLoads(GSAModel=model_2, Unit="m")  # -> LC, Gr, No, Be, Fa, Pt, Ln, Ar, GPS
model_9 = CreateModel(GSAGeometryIn_m=elem1dedit.Element1D, Load=beamload_4, ReMesh=True, Tolerance=0.05, Unit="m")
getloads_3 = GetModelLoads(GSAModel=model_6, Unit="m")  # -> LC, Gr, No, Be, Fa, Pt, Ln, Ar, GPS
getloads_4 = GetModelLoads(GSAModel=model_5, Unit="m")  # -> LC, Gr, No, Be, Fa, Pt, Ln, Ar, GPS
getloads_5 = GetModelLoads(GSAModel=model_4, Unit="m")  # -> LC, Gr, No, Be, Fa, Pt, Ln, Ar, GPS
getgeo_3 = GetModelGeometry(GSAModel=model_5, NodeFilterList="All", ElementFilterList="All", MemberFilterList="All", Mode=1, Unit="m")  # -> Nodes_m, _1DElements_m, _2DElements_m, _3DElements_m, _1DMembers_m, _2DMembers_m, _3DMembers_m
loadprop_2 = LoadProperties(Load=getloads_2.Fa, Force_Unit="kN", Length_Unit="m")  # -> LoadCase, Name, ElementsNodesDefinition, Axis, Direction, Projected, LoadValueOrFactorX_forceUnitAbbreviation_kN_forcePerLengthUnit_kN_m_forcePerAreaUnit_kN_m², LoadValueOrFactorY_forceUnitAbbreviation_kN_forcePerLengthUnit_kN_m_forcePerAreaUnit_kN_m²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
getgeo_4 = GetModelGeometry(GSAModel=model_4, NodeFilterList="All", ElementFilterList="All", MemberFilterList="All", Mode=1, Unit="m")  # -> Nodes_m, _1DElements_m, _2DElements_m, _3DElements_m, _1DMembers_m, _2DMembers_m, _3DMembers_m
getloads_6 = GetModelLoads(GSAModel=model_8, Unit="m")  # -> LC, Gr, No, Be, Fa, Pt, Ln, Ar, GPS
model_10 = CreateModel(Load=nodeload, ReMesh=True, Tolerance=0.05, Unit="m")
getloads_7 = GetModelLoads(GSAModel=model_3, Unit="m")  # -> LC, Gr, No, Be, Fa, Pt, Ln, Ar, GPS
getloads_8 = GetModelLoads(GSAModel=model_7, Unit="m")  # -> LC, Gr, No, Be, Fa, Pt, Ln, Ar, GPS
elem2dedit = Edit2DElement(Element2D=getgeo_2._2DElements_m, Preview3dSection=False)  # -> Element2D, Number, AnalysisMesh, _2DProperty, Group, ElementType, Offset, OrientationAngle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
getgeo_5 = GetModelGeometry(GSAModel=model_7, NodeFilterList="All", ElementFilterList="All", MemberFilterList="All", Mode=1, Unit="m")  # -> Nodes_m, _1DElements_m, _2DElements_m, _3DElements_m, _1DMembers_m, _2DMembers_m, _3DMembers_m
getgeo_6 = GetModelGeometry(GSAModel=model_8, NodeFilterList="All", ElementFilterList="All", MemberFilterList="All", Mode=1, Unit="m")  # -> Nodes_m, _1DElements_m, _2DElements_m, _3DElements_m, _1DMembers_m, _2DMembers_m, _3DMembers_m
ld = Load([nodeload_2, nodeload_4, nodeload_5, nodeload_3])
loadprop_3 = LoadProperties(Load=getloads_3.Fa, Force_Unit="kN", Length_Unit="m")  # -> LoadCase, Name, ElementsNodesDefinition, Axis, Direction, Projected, LoadValueOrFactorX_forceUnitAbbreviation_kN_forcePerLengthUnit_kN_m_forcePerAreaUnit_kN_m², LoadValueOrFactorY_forceUnitAbbreviation_kN_forcePerLengthUnit_kN_m_forcePerAreaUnit_kN_m²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
getloads_9 = GetModelLoads(GSAModel=model_9, Unit="m")  # -> LC, Gr, No, Be, Fa, Pt, Ln, Ar, GPS
loadprop_4 = LoadProperties(Load=getloads_4.Fa, Force_Unit="kN", Length_Unit="m")  # -> LoadCase, Name, ElementsNodesDefinition, Axis, Direction, Projected, LoadValueOrFactorX_forceUnitAbbreviation_kN_forcePerLengthUnit_kN_m_forcePerAreaUnit_kN_m², LoadValueOrFactorY_forceUnitAbbreviation_kN_forcePerLengthUnit_kN_m_forcePerAreaUnit_kN_m²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
getgeo_7 = GetModelGeometry(GSAModel=model_9, NodeFilterList="All", ElementFilterList="All", MemberFilterList="All", Mode=1, Unit="m")  # -> Nodes_m, _1DElements_m, _2DElements_m, _3DElements_m, _1DMembers_m, _2DMembers_m, _3DMembers_m
loadprop_5 = LoadProperties(Load=getloads_5.Be, Force_Unit="kN", Length_Unit="m")  # -> LoadCase, Name, ElementsNodesDefinition, Axis, Direction, Projected, LoadValueOrFactorX_forceUnitAbbreviation_kN_forcePerLengthUnit_kN_m_forcePerAreaUnit_kN_m², LoadValueOrFactorY_forceUnitAbbreviation_kN_forcePerLengthUnit_kN_m_forcePerAreaUnit_kN_m²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
loadprop_6 = LoadProperties(Load=getloads_6.Gr, Force_Unit="kN", Length_Unit="m")  # -> LoadCase, Name, ElementsNodesDefinition, Axis, Direction, Projected, LoadValueOrFactorX_forceUnitAbbreviation_kN_forcePerLengthUnit_kN_m_forcePerAreaUnit_kN_m², LoadValueOrFactorY_forceUnitAbbreviation_kN_forcePerLengthUnit_kN_m_forcePerAreaUnit_kN_m²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
loadprop_7 = LoadProperties(Load=getloads_7.Be, Force_Unit="kN", Length_Unit="m")  # -> LoadCase, Name, ElementsNodesDefinition, Axis, Direction, Projected, LoadValueOrFactorX_forceUnitAbbreviation_kN_forcePerLengthUnit_kN_m_forcePerAreaUnit_kN_m², LoadValueOrFactorY_forceUnitAbbreviation_kN_forcePerLengthUnit_kN_m_forcePerAreaUnit_kN_m²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
gridplanesurfaceprop = GridPlaneSurfaceProperties(GridPlaneSurface=getloads_8.GPS, LengthUnit="Meter")  # -> GridPlane, GridPlaneID, GridPlaneName, IsStorey, Axis, AxisID, Elevation_m, GridPlaneToleranceAbove_m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
int_3 = Integer(getgeo_4._1DMembers_m)
getloads_10 = GetModelLoads(GSAModel=model_10, Unit="m")  # -> LC, Gr, No, Be, Fa, Pt, Ln, Ar, GPS
int_4 = Integer(elem2dedit.Number)
loadprop_8 = LoadProperties(Load=getloads_9.Be, Force_Unit="kN", Length_Unit="m")  # -> LoadCase, Name, ElementsNodesDefinition, Axis, Direction, Projected, LoadValueOrFactorX_forceUnitAbbreviation_kN_forcePerLengthUnit_kN_m_forcePerAreaUnit_kN_m², LoadValueOrFactorY_forceUnitAbbreviation_kN_forcePerLengthUnit_kN_m_forcePerAreaUnit_kN_m²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
panel_5 = Panel(loadprop_2.ElementsNodesDefinition)
int_5 = Integer(getgeo_7._1DElements_m)
model_11 = CreateModel(GSAGeometryIn_m=mem2dedit.Member2D, Load=ld, ReMesh=True, Tolerance=0.05, Unit="m")
split = TextSplit(Text=loadprop_2.ElementsNodesDefinition, Separators=" ")
panel_6 = Panel(loadprop_4.ElementsNodesDefinition)
loadprop_9 = LoadProperties(Load=getloads_10.No, Force_Unit="kN", Length_Unit="m")  # -> LoadCase, Name, ElementsNodesDefinition, Axis, Direction, Projected, LoadValueOrFactorX_forceUnitAbbreviation_kN_forcePerLengthUnit_kN_m_forcePerAreaUnit_kN_m², LoadValueOrFactorY_forceUnitAbbreviation_kN_forcePerLengthUnit_kN_m_forcePerAreaUnit_kN_m²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
item = ListItem(List=gridplanesurfaceprop.Elements, Index=0, Wrap=True)  # -> Item, Item1, Item2, Item3, Item4, Item5
item_2 = ListItem(List=loadprop_6.ElementsNodesDefinition, Index=0, Wrap=True)  # -> Item, Item1, Item2, Item3, Item4, Item5, Item6
split_2 = TextSplit(Text=loadprop_5.ElementsNodesDefinition, Separators=" ")
int_6 = Integer(split)
split_3 = TextSplit(Text=loadprop_4.ElementsNodesDefinition, Separators=" ")
int_7 = Integer(getgeo_3._2DMembers_m)
int_8 = Integer(loadprop_8.ElementsNodesDefinition)

# ---- group: FaceLoadFromProp2dTest
txt = Text(loadprop_3.ElementsNodesDefinition)

# ---- group: BeamLoadFromSectionTest
txt_2 = Text(loadprop_7.ElementsNodesDefinition)

# ----
item_3 = ListItem(List=getgeo_5._2DElements_m, Index=0, Wrap=True)  # -> Item, Item1
item_4 = ListItem(List=getgeo_6._2DElements_m, Index=0, Wrap=True)  # -> Item, Item1
getgeo_8 = GetModelGeometry(GSAModel=model_11, NodeFilterList="All", ElementFilterList="All", MemberFilterList="All", Mode=1, Unit="m")  # -> Nodes_m, _1DElements_m, _2DElements_m, _3DElements_m, _1DMembers_m, _2DMembers_m, _3DMembers_m
getloads_11 = GetModelLoads(GSAModel=model_11, Unit="m")  # -> GravityLoads, NodeLoads, BeamLoads, FaceLoads, GridPointLoads_m, GridLineLoads_m, GridAreaLoads_m, GridPlaneSurfaces_m
int_9 = Integer(split_2)
int_10 = Integer(split_3)
keysearch = KeyValueSearch(Keys=int_6, Values=int_6, Search=int_4)
int_11 = Integer(getgeo_6._1DElements_m)
equals = Equality(FirstNumber=int_5, SecondNumber=int_8)  # -> Equality, Inequality

# ---- group: NodeLoadOldID
int_12 = Integer(loadprop_9.LoadCase)

# ----
equals_2 = Equality(FirstNumber=int, SecondNumber=int_2)  # -> Equality, Inequality

# ---- group: NodeLoadOldName
txt_3 = Text(loadprop_9.Name)

# ----
panel_7 = Panel(txt)
panel_8 = Panel(txt_2)

# ---- group: NodeLoadOldDefinition
txt_4 = Text(loadprop_9.ElementsNodesDefinition)

# ---- group: LoadNodeOldDirection
txt_5 = Text(loadprop_9.Direction)

# ----
int_13 = Integer(getgeo_5._1DElements_m)
keysearch_2 = KeyValueSearch(Keys=int_9, Values=int_9, Search=int_3)
equals_3 = Equality(FirstNumber=int_4, SecondNumber=keysearch)  # -> Equality, Inequality
keysearch_3 = KeyValueSearch(Keys=int_10, Values=int_10, Search=int_7)
mem2dedit_2 = Edit2DMember(Member2D=getgeo_8._2DMembers_m)  # -> Member2D, MemberNumber, Brep, InclPoints, InclCurves, _2DProperty, MemberGroup, MemberType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
loadprop_10 = LoadProperties(Load=getloads_11.NodeLoads, Force_Unit="kN", Length_Unit="m")  # -> LC, Na, Def, Ax, Di, Pj, V1, V2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
cull_i = CullIndex(List=int_11, Indices="0", Wrap=True)

# ---- group: BeamLoadFromElementTest
bool = Boolean(equals.Equality)

# ----
cull_i_2 = CullIndex(List=int_13, Indices="0", Wrap=True)
panel_9 = Panel(txt_3)

# ---- group: BeamLoadFromElementOldTest
bool_2 = Boolean(equals_2.Equality)

# ----
panel_10 = Panel(txt_4)
equals_4 = Equality(FirstNumber=int_3, SecondNumber=keysearch_2)  # -> Equality, Inequality
ma = MassAddition(Input=equals_3.Inequality)  # -> Result, PartialResults
elem2dedit_2 = Edit2DElement(Element2D=item_3.Item1, Preview3dSection=False)  # -> Element2D, Number, AnalysisMesh, _2DProperty, Group, ElementType, Offset, OrientationAngle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
equals_5 = Equality(FirstNumber=int_7, SecondNumber=keysearch_3)  # -> Equality, Inequality
elem2dedit_3 = Edit2DElement(Element2D=item_3.Item, Preview3dSection=False)  # -> Element2D, Number, AnalysisMesh, _2DProperty, Group, ElementType, Offset, OrientationAngle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
elem2dedit_4 = Edit2DElement(Element2D=item_4.Item, Preview3dSection=False)  # -> Element2D, Number, AnalysisMesh, _2DProperty, Group, ElementType, Offset, OrientationAngle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
elem2dedit_5 = Edit2DElement(Element2D=item_4.Item1, Preview3dSection=False)  # -> Element2D, Number, AnalysisMesh, _2DProperty, Group, ElementType, Offset, OrientationAngle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
faceload_4 = CreateFaceLoad(
    LoadCase=1,
    ElementList=panel_5,
    Axis=-1,
    Direction="z",
    Projected=False,
    Value1_kN_m²=Slider(4, range=0..10),
    Value2_kN_m²=Slider(4, range=0..10),
    Value3_kN_m²=Slider(4, range=0..10),
    Value4_kN_m²=Slider(4, range=0..10),
    Type="Variable",
    Unit="kN/m²")
panel_11 = Panel(bool)
panel_12 = Panel(bool_2)
ma_2 = MassAddition(Input=equals_4.Inequality)  # -> Result, PartialResults

# ---- group: FaceLoadFromElementTest
int_14 = Integer(ma.Result)

# ----
ma_3 = MassAddition(Input=equals_5.Inequality)  # -> Result, PartialResults
split_4 = TextSplit(Text=item.Item5, Separators=" ")
int_15 = Integer(elem2dedit_2.Number)
split_5 = TextSplit(Text=item_2.Item5, Separators=" ")
split_6 = TextSplit(Text=item.Item3, Separators=" ")
int_16 = Integer(elem2dedit_5.Number)
int_17 = Integer(elem2dedit_3.Number)
split_7 = TextSplit(Text=item.Item4, Separators=" ")
split_8 = TextSplit(Text=item_2.Item3, Separators=" ")
int_18 = Integer(elem2dedit_4.Number)
split_9 = TextSplit(Text=item_2.Item4, Separators=" ")
split_10 = TextSplit(Text=mem2dedit_2.Topology, Separators="()")
zero_if_all_ids_found = Panel(int_14)

# ---- group: BeamLoadFromMemberTest
int_19 = Integer(ma_2.Result)

# ---- group: FaceLoadFromMemberTest
int_20 = Integer(ma_3.Result)

# ----
int_21 = Integer(split_4)
int_22 = Integer(split_5)
int_23 = Integer(split_6)
int_24 = Integer(split_7)
int_25 = Integer(split_8)
item_5 = ListItem(List=split_10, Index="1", Wrap=True)
int_26 = Integer(split_9)
model_12 = CreateModel(GSAGeometryIn_m=elem2d, Load=faceload_4, ReMesh=True, Tolerance=0.05, Unit="m")
zero_if_all_ids_found_2 = Panel(int_19)
zero_if_all_ids_found_3 = Panel(int_20)
split_11 = TextSplit(Text=item_5, Separators=" ")
keysearch_4 = KeyValueSearch(Keys=int_21, Values=int_21, Search=int_15)
keysearch_5 = KeyValueSearch(Keys=int_24, Values=int_24, Search=cull_i_2)
keysearch_6 = KeyValueSearch(Keys=int_22, Values=int_22, Search=int_16)
keysearch_7 = KeyValueSearch(Keys=int_23, Values=int_23, Search=int_17)
keysearch_8 = KeyValueSearch(Keys=int_26, Values=int_26, Search=cull_i)
keysearch_9 = KeyValueSearch(Keys=int_25, Values=int_25, Search=int_18)
split_12 = TextSplit(Text=loadprop_10.Def, Separators=" ")  # -> flatten(Result)
equals_6 = Equality(FirstNumber=int_15, SecondNumber=keysearch_4)  # -> Equality, Inequality
equals_7 = Equality(FirstNumber=cull_i_2, SecondNumber=keysearch_5)  # -> Equality, Inequality
int_27 = Integer(split_11)
equals_8 = Equality(FirstNumber=int_16, SecondNumber=keysearch_6)  # -> Equality, Inequality
equals_9 = Equality(FirstNumber=int_17, SecondNumber=keysearch_7)  # -> Equality, Inequality
equals_10 = Equality(FirstNumber=cull_i, SecondNumber=keysearch_8)  # -> Equality, Inequality
equals_11 = Equality(FirstNumber=int_18, SecondNumber=keysearch_9)  # -> Equality, Inequality
int_28 = Integer(split_12)
getloads_12 = GetModelLoads(GSAModel=model_12, Unit="m")  # -> GravityLoads, NodeLoads, BeamLoads, FaceLoads, GridPointLoads_m, GridLineLoads_m, GridAreaLoads_m, GridPlaneSurfaces_m
ma_4 = MassAddition(Input=equals_6.Inequality)  # -> Result, PartialResults
ma_5 = MassAddition(Input=equals_7.Inequality)  # -> Result, PartialResults
ma_6 = MassAddition(Input=equals_8.Inequality)  # -> Result, PartialResults
ma_7 = MassAddition(Input=equals_9.Inequality)  # -> Result, PartialResults
ma_8 = MassAddition(Input=equals_10.Inequality)  # -> Result, PartialResults
ma_9 = MassAddition(Input=equals_11.Inequality)  # -> Result, PartialResults
keysearch_10 = KeyValueSearch(Keys=int_28, Values=int_28, Search=int_27)

# ---- group: GridPlnSrfFromMem2dTest
int_29 = Integer(ma_4.Result)

# ----
loadprop_11 = LoadProperties(Load=getloads_12.FaceLoads, Force_Unit="kN", Length_Unit="m")  # -> LC, Na, Def, Ax, Di, Pj, V1, V2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

# ---- group: GravityLoadFromMember2dTest
int_30 = Integer(ma_6.Result)

# ---- group: GridPlnSrfFromElem2dTest
int_31 = Integer(ma_7.Result)

# ---- group: GridPlnSrfFromMem1dTest
int_32 = Integer(ma_5.Result)

# ---- group: GravityOldTest
txt_6 = Text(item_2.Item6)

# ---- group: GridPlnSrfFromElem1dTest
int_33 = Integer(item.Item2)

# ---- group: GravityLoadFromElem2dTest
int_34 = Integer(ma_9.Result)

# ---- group: GravityLoadFromMember1dTest
int_35 = Integer(ma_8.Result)

# ---- group: GridPlnSrfFromProp2dTest
txt_7 = Text(item.Item1)

# ---- group: GravityLoadFromElem1dTest
int_36 = Integer(item_2.Item2)

# ---- group: GridPlnSrfFromSectionTest
txt_8 = Text(item.Item)

# ---- group: GravityLoadFromProp2dTest
txt_9 = Text(item_2.Item1)

# ---- group: GravityLoadFromSectionTest
txt_10 = Text(item_2.Item)

# ----
equals_12 = Equality(FirstNumber=int_27, SecondNumber=keysearch_10)  # -> Equality, Inequality
zero_if_all_ids_found_4 = Panel(int_29)
zero_if_all_ids_found_5 = Panel(int_30)
zero_if_all_ids_found_6 = Panel(int_31)
zero_if_all_ids_found_7 = Panel(int_32)
zero_if_all_ids_found_8 = Panel(int_34)
zero_if_all_ids_found_9 = Panel(int_35)
zero_if_all_ids_found_10 = Panel(txt_6)
ma_10 = MassAddition(Input=equals_12.Inequality)  # -> Result, PartialResults
panel_13 = Panel(int_33)
panel_14 = Panel(txt_7)
panel_15 = Panel(txt_8)
panel_16 = Panel(int_36)
panel_17 = Panel(txt_9)
panel_18 = Panel(txt_10)
panel_19 = Panel(loadprop_11.Def)

# ---- group: FaceLoadsFromElementOldApplied
txt_11 = Text(loadprop_11.Def)

# ---- group: NodeLoadFromPtTest
int_37 = Integer(ma_10.Result)

# ----
zero_if_all_ids_found_11 = Panel(int_37)
