# Grasshopper definition NodeReactionForceResult.gh (Grasshopper 1.0.7)
# plug-ins: GSA

# ---- group: Chord sections
profile = CreateProfile(
    catalogueIndex=3,
    lengthUnit="Centimeter",
    mode="Catalogue",
    Profile_type="Catalogue",
    Catalogue="Europrofile",
    Type="EP HE beams",
    Profile="HE HE450.B",
    typeIndex=27)
material = CreateCustomMaterial(
    ElasticModulus_MPa="210000",
    PoissonsRatio=".3",
    Density_kg_m³="7850",
    Material_Type="Timber",
    Stress_Unit="MPa",
    Density_Unit="kg/m³",
    Temperature_Unit="°C")
section = CreateSection(Profile=profile, Material=material, Basic_Offset="Centroid")

# ----
number_slider = Slider(15, range=0..100)
pt = ConstructPoint(XCoordinate=0, YCoordinate=number_slider, ZCoordinate=0)
pt_2 = ConstructPoint(XCoordinate=0, YCoordinate=0, ZCoordinate=0)
ln = Line(StartPoint=pt_2, EndPoint=pt)
mem1d = Create1DMember(
    Curve=ln,
    Section=section,
    Preview3dSection=False,
    x1=False,
    x2=False,
    xx1=False,
    xx2=False,
    y1=False,
    y2=False,
    yy1=False,
    yy2=False,
    z1=False,
    z2=False,
    zz1=False,
    zz2=False)
division = Division(A=number_slider, B=Slider(9, range=9..30))
Z = UnitZ(Factor=division)
support = CreateSupport(Point=pt_2, Plane=PlaneXY(0, 0, 0), x=True, xx=True, y=True, yy=True, z=True, zz=True)

# ---- group: Vertical sections
profile_2 = CreateProfile(
    catalogueIndex=3,
    lengthUnit="Centimeter",
    mode="Catalogue",
    Profile_type="Catalogue",
    Catalogue="Europrofile",
    Type="EP HE beams",
    Profile="HE HE100.A",
    typeIndex=27)
material_2 = CreateCustomMaterial(
    ElasticModulus_MPa="210000",
    PoissonsRatio=".3",
    Density_kg_m³="7850",
    Material_Type="Timber",
    Stress_Unit="MPa",
    Density_Unit="kg/m³",
    Temperature_Unit="°C")
section_2 = CreateSection(Profile=profile_2, Material=material_2, Basic_Offset="Centroid")

# ----
move = Move(Geometry=support, Motion=Z)  # -> Geometry, Transform
move_2 = Move(Geometry=mem1d, Motion=Z)  # -> Geometry, Transform
divide = DivideCurve(Curve=move_2.Geometry, Count=Slider(7, range=5..15), Kinks=False)  # -> Points, Tangents, Parameters
rev = Reverse(Vector=Z)
no = Node([move.Geometry, support])
line = LineSDL(Start=divide.Points, Direction=rev, Length=rev)
m1d = _1DMember([mem1d, move_2.Geometry])
end = EndPoints(Curve=line)  # -> Start, End
shift = ShiftList(List=end.End, Shift=1, Wrap=False)
ln_2 = Line(StartPoint=divide.Points, EndPoint=shift)
X = UnitX(Factor=Slider(3, range=0..10))
no_2 = Node(no)
line_2 = LineSDL(Start=divide.Points, Direction=X, Length=X)
move_3 = Move(Geometry=no_2, Motion=X)  # -> Geometry, Transform
mem1d_2 = Create1DMember(
    Curve=[ln_2, line],
    Section=section_2,
    Preview3dSection=False,
    x1=False,
    x2=False,
    xx1=False,
    xx2=False,
    y1=False,
    y2=False,
    yy1=False,
    yy2=False,
    z1=False,
    z2=False,
    zz1=False,
    zz2=False)
no_3 = Node([no_2, move_3.Geometry])
mem1d_3 = Create1DMember(
    Curve=line_2,
    Section=section_2,
    Preview3dSection=False,
    x1=False,
    x2=False,
    xx1=False,
    xx2=False,
    y1=False,
    y2=False,
    yy1=False,
    yy2=False,
    z1=False,
    z2=False,
    zz1=False,
    zz2=False)
m1d_2 = _1DMember([m1d, mem1d_2])
move_4 = Move(Geometry=m1d_2, Motion=X)  # -> Geometry, Transform
m1d_3 = _1DMember([m1d_2, move_4.Geometry])
gravityload = CreateGravityLoad(LoadCase=null, GravityFactor=Vector(0, 0, -1))
analyse = AnalyseModel(
    GSAGeometryIn_m=flatten([no_3, m1d_3, mem1d_3]),
    Loads=gravityload,
    Analyse=True,
    ReMesh=True,
    Tolerance=0.05,
    Geometry_Unit="Meter")  # -> Model, Report
selres = SelectResults(GSAModel=analyse.Model, RT="A", Case="1", Type="AnalysisCase", Case_ID="A1")
res = Result(selres)
reactionforce = ReactionForceDiagrams(
    Result=res,
    Annotation=False,
    SignificantDigits="6",
    Display=0,
    force="kN",
    length="in",
    model="m",
    moment="kN·m",
    Component="Reaction Fx")  # -> DiagramLines, Annotations
reactionforce_2 = ReactionForceDiagrams(
    Result=res,
    Annotation=False,
    SignificantDigits="6",
    Display=1,
    force="kN",
    length="in",
    model="m",
    moment="kN·m",
    Component="Reaction Fy")  # -> DiagramLines, Annotations
reactionforce_3 = ReactionForceDiagrams(
    Result=res,
    Annotation=False,
    SignificantDigits="6",
    Display=2,
    force="kN",
    length="in",
    model="m",
    moment="kN·m",
    Component="Reaction Fz")  # -> DiagramLines, Annotations
reactionforce_4 = ReactionForceDiagrams(
    Result=res,
    Annotation=False,
    SignificantDigits="6",
    Display=3,
    force="kN",
    length="in",
    model="m",
    moment="kN·m",
    Component="Resolved |F|")  # -> DiagramLines, Annotations
reactionforce_5 = ReactionForceDiagrams(
    Result=res,
    Annotation=False,
    SignificantDigits="6",
    Display=4,
    force="kN",
    length="in",
    model="m",
    moment="kN·m",
    Component="Reaction Mxx")  # -> DiagramLines, Annotations
reactionforce_6 = ReactionForceDiagrams(
    Result=res,
    Annotation=False,
    SignificantDigits="6",
    Display=5,
    force="kN",
    length="in",
    model="m",
    moment="kN·m",
    Component="Reaction Myy")  # -> DiagramLines, Annotations
reactionforce_7 = ReactionForceDiagrams(
    Result=res,
    Annotation=False,
    SignificantDigits="6",
    Display=6,
    force="kN",
    length="in",
    model="m",
    moment="kN·m",
    Component="Reaction Mzz")  # -> DiagramLines, Annotations
reactionforce_8 = ReactionForceDiagrams(
    Result=res,
    Annotation=False,
    SignificantDigits="6",
    Display=7,
    force="kN",
    length="in",
    model="m",
    moment="kN·m",
    Component="Resolved |M|")  # -> DiagramLines, Annotations

# ---- group: Fx
num = Number(flatten(reactionforce.Annotations))

# ---- group: Fy
num_2 = Number(flatten(reactionforce_2.Annotations))

# ---- group: F
num_3 = Number(flatten(reactionforce_4.Annotations))

# ---- group: Mxx
num_4 = Number(flatten(reactionforce_5.Annotations))

# ---- group: Mzz
num_5 = Number(flatten(reactionforce_7.Annotations))

# ---- group: Fz
num_6 = Number(flatten(reactionforce_3.Annotations))

# ---- group: M
num_7 = Number(flatten(reactionforce_8.Annotations))

# ---- group: Myy
num_8 = Number(flatten(reactionforce_6.Annotations))

# ----
fx = Panel(num)
fy = Panel(num_2)
fz = Panel(num_6)
F = Panel(num_3)
mxx = Panel(num_4)
mzz = Panel(num_5)
M = Panel(num_7)
myy = Panel(num_8)
