# Grasshopper definition NodeResults.gh (Grasshopper 1.0.7)
# Copyright: Arup
# plug-ins: GSA

panel = Panel("https://samples.oasys-software.com/gsa/10.1/Training_General/TrGen_10.gwb")
c_script = CSharpScript(x=panel)  # -> A; inputs x: String
# ---------- c_script: C# usings ----------
using System.Linq;
# ---------- c_script: C# ----------
    string filePath = System.IO.Path.GetTempPath();
    string fileName = x.Split('/').Last();
    //create webclient and download example file:
    System.Net.WebClient webClient = new System.Net.WebClient();
    webClient.DownloadFile(
      x,
      filePath + fileName);

    A = filePath + fileName;
# ---------- end c_script ----------
open = OpenModel(FilenameAndPath=c_script, File="C:\Users\kristjan.nielsen\AppData\Local\Temp\TrGen_10.gwb")
createcombination = CreateCombinationCase(Name="Envelope 1", Description="(C1 or 1.5C1)")
analyse = AnalyseModel(ModelS=open, AnalysisTasksCombinations=createcombination, Analyse=True, ReMesh=True, Tolerance=0.05, Unit="m")
getcases = GetResultCases(GSAModel=analyse)  # -> T, Case, Permutation
getres = GetResults(GSAModel=analyse, T="C", Case="3")

# ---- group: Permutations
int = Integer(getcases.Permutation)

# ----
panel_2 = Panel(int)
res = Result(getres)
reacforce = ReactionForces(Result=res, NodeFilterList="All", Force_Unit="kipf", Moment_Unit="kipf·ft")  # -> ForceX_kipf, ForceY_kipf, ForceZ_kipf, ForceXYZ_kipf, MomentXX_kipf_ft, MomentYY_kipf_ft, MomentZZ_kipf_ft, MomentXXYYZZ_kipf_ft, NodesIDs
nodedisp = NodeDisplacements(Result=res, NodeFilterList="3351", Unit="mm")  # -> TranslationsX_mm, TranslationsY_mm, TranslationsZ_mm, TranslationsXYZ_mm, RotationsXX_rad, RotationsYY_rad, RotationsZZ_rad, RotationsXYZ_rad, NodesIDs
flip = FlipMatrix(Data=reacforce.NodesIDs)
sort = SortList(Keys=flatten(reacforce.MomentYY_kipf_ft))  # -> Keys, ValuesA
sort_2 = SortList(Keys=flatten(reacforce.MomentZZ_kipf_ft))  # -> Keys, ValuesA
sort_3 = SortList(Keys=flatten(reacforce.MomentXXYYZZ_kipf_ft))  # -> Keys, ValuesA
sort_4 = SortList(Keys=flatten(reacforce.ForceY_kipf))  # -> Keys, ValuesA
sort_5 = SortList(Keys=flatten(reacforce.ForceZ_kipf))  # -> Keys, ValuesA
sort_6 = SortList(Keys=flatten(reacforce.ForceXYZ_kipf))  # -> Keys, ValuesA
sort_7 = SortList(Keys=flatten(reacforce.MomentXX_kipf_ft))  # -> Keys, ValuesA
sort_8 = SortList(Keys=flatten(reacforce.ForceX_kipf))  # -> Keys, ValuesA
item = ListItem(List=flip, Index=0, Wrap=True)
item_2 = ListItem(List=sort.Keys, Index=0, Wrap=True)  # -> Item1, Item
item_3 = ListItem(List=sort_2.Keys, Index=0, Wrap=True)  # -> Item1, Item
item_4 = ListItem(List=sort_3.Keys, Index=0, Wrap=True)  # -> Item1, Item
item_5 = ListItem(List=sort_4.Keys, Index=0, Wrap=True)  # -> Item1, Item
item_6 = ListItem(List=sort_5.Keys, Index=0, Wrap=True)  # -> Item1, Item
item_7 = ListItem(List=sort_6.Keys, Index=0, Wrap=True)  # -> Item1, Item
item_8 = ListItem(List=sort_7.Keys, Index=0, Wrap=True)  # -> Item1, Item
item_9 = ListItem(List=sort_8.Keys, Index=0, Wrap=True)  # -> Item1, Item
flip_2 = FlipMatrix(Data=item)

# ---- group: Uz
num = Number(nodedisp.TranslationsZ_mm)

# ---- group: Ux
num_2 = Number(nodedisp.TranslationsX_mm)

# ---- group: Uy
num_3 = Number(nodedisp.TranslationsY_mm)

# ---- group: U
num_4 = Number(nodedisp.TranslationsXYZ_mm)

# ---- group: Rxx
num_5 = Number(nodedisp.RotationsXX_rad)

# ---- group: Ryy
num_6 = Number(nodedisp.RotationsYY_rad)

# ---- group: Rzz
T = Number(nodedisp.RotationsZZ_rad)

# ---- group: R
num_7 = Number(nodedisp.RotationsXYZ_rad)

# ---- group: Fy
num_8 = Number([item_5.Item1, item_5.Item])

# ---- group: Fz
num_9 = Number([item_6.Item1, item_6.Item])

# ---- group: F
num_10 = Number([item_7.Item1, item_7.Item])

# ---- group: Myy
num_11 = Number([item_2.Item1, item_2.Item])

# ---- group: Mzz
num_12 = Number([item_3.Item1, item_3.Item])

# ---- group: M
num_13 = Number([item_4.Item1, item_4.Item])

# ---- group: Mxx
num_14 = Number([item_8.Item1, item_8.Item])

# ---- group: Rids
int_2 = Integer(flip_2)

# ---- group: Fx
num_15 = Number([item_9.Item1, item_9.Item])

# ----
panel_3 = Panel(num_11)
panel_4 = Panel(num_12)
panel_5 = Panel(num_13)
panel_6 = Panel(num_8)
panel_7 = Panel(num_9)
panel_8 = Panel(num_10)
panel_9 = Panel(num_14)
panel_10 = Panel(num_15)
panel_11 = Panel(num_2)
panel_12 = Panel(num_3)
panel_13 = Panel(num)
panel_14 = Panel(num_4)
panel_15 = Panel(num_5)
panel_16 = Panel(num_6)
panel_17 = Panel(T)
panel_18 = Panel(num_7)
panel_19 = Panel(int_2)
