# Grasshopper definition SectionAlignment.gh (Grasshopper 1.0.7)
# plug-ins: GSA

brep = Brep(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)
profile = CreateProfile(
    catalogueIndex=3,
    lengthUnit="Centimeter",
    mode="Catalogue",
    Profile_type="Catalogue",
    Catalogue="Europrofile",
    Type="EP HE beams",
    Profile="HE HE700.B",
    typeIndex=27)
pt = ConstructPoint(XCoordinate=0, YCoordinate=0, ZCoordinate=0)
pt_2 = ConstructPoint(XCoordinate=0, YCoordinate=Slider(15, range=0..100), ZCoordinate=0)
prop2d = Create2DProperty(Thickness_cm=Slider(150, range=0..1000), Type="Shell", Unit="cm")
mem2d = Create2DMember(Brep=brep, Property2D=prop2d, InternalOffset=True, Preview3dSection=False, Mesh_mode="Quad dominant")
section = CreateSection(Profile=profile, Basic_Offset="Centroid")
ln = Line(StartPoint=pt, EndPoint=pt_2)
mem1d = Create1DMember(
    Curve=ln,
    Section=section,
    Preview3dSection=False,
    x1=False,
    x2=False,
    xx1=False,
    xx2=False,
    y1=False,
    y2=False,
    yy1=False,
    yy2=False,
    z1=False,
    z2=False,
    zz1=False,
    zz2=False)
align = SectionAlignment(ElementMember1D2D=[mem2d, mem1d], Alignment="Bottom-Left")  # -> ElementMember1D2D, Offset
offsetedit = EditOffset(Offset=align.Offset, LengthUnit="Millimeter")  # -> Offset, X1_mm, X2_mm, Y_mm, Z_mm

# ---- group: Z
num = Number(offsetedit.Z_mm)

# ---- group: Y
num_2 = Number(offsetedit.Y_mm)

# ----
panel = Panel(num_2)
panel_2 = Panel(num)
