# Grasshopper definition TaperPerimeterProfiles.gh (Grasshopper 1.0.7)
# plug-ins: GSA

crv = Curve(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)
crv_2 = Curve(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)
crv_3 = Curve(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)
profile = CreateProfile(
    Boundary=crv_3,
    NumberOfInputs=1,
    catalogueIndex=-1,
    inclSS=False,
    lengthUnit="Centimeter",
    mode="Other",
    Profile_type="Perimeter",
    Measure="Centimeter",
    typeIndex=-1)
profile_2 = CreateProfile(
    Boundary=crv_2,
    NumberOfInputs=1,
    catalogueIndex=-1,
    inclSS=False,
    lengthUnit="Centimeter",
    mode="Other",
    Profile_type="Perimeter",
    Measure="Centimeter",
    typeIndex=-1)
profile_3 = CreateProfile(
    Boundary=crv,
    NumberOfInputs=1,
    catalogueIndex=-1,
    inclSS=False,
    lengthUnit="Centimeter",
    mode="Other",
    Profile_type="Perimeter",
    Measure="Centimeter",
    typeIndex=-1)
taper = TaperProfile(ProfileStart=profile_3, ProfileEnd=profile_2)
taper_2 = TaperProfile(ProfileStart=profile_3, ProfileEnd=profile)
null = NullItem(Item=taper_2)  # -> NullFlags, InvalidFlags, Description

# ---- group: Test1
txt = Text(taper)

# ---- group: Test2
bool = Boolean(null.NullFlags)

# ----
panel = Panel(txt)
panel_2 = Panel(bool)
