# Grasshopper definition GsaList_Elements.gh (Grasshopper 1.0.7)
# Copyright: Arup
# plug-ins: GSA

profile = CreateProfile(
    catalogueIndex=3,
    inclSS=False,
    lengthUnit="Centimeter",
    mode="Catalogue",
    Profile_type="Catalogue",
    Catalogue="Europrofile",
    Type="EP HE beams",
    Profile="HE HE600.B",
    typeIndex=27)
pt = ConstructPoint(XCoordinate=0, YCoordinate=0, ZCoordinate=0)
pt_2 = ConstructPoint(XCoordinate=0, YCoordinate=0, ZCoordinate="7")
pt_3 = ConstructPoint(XCoordinate=0, YCoordinate="10", ZCoordinate="7")
pt_4 = ConstructPoint(XCoordinate=0, YCoordinate="10", ZCoordinate=0)
material = CustomMaterial(E="210000", ν="0.3", ρ="7850", Material_Type="Timber", Stress_Unit="MPa", Density_Unit="kg/m³", Temperature_Unit="°C")
pt_5 = ConstructPoint(XCoordinate="4", YCoordinate=0, ZCoordinate=0)
material_2 = CustomMaterial(E="18000", ν="0.3", ρ="2500", Material_Type="Timber", Stress_Unit="MPa", Density_Unit="kg/m³", Temperature_Unit="°C")
pt_6 = ConstructPoint(XCoordinate="4", YCoordinate="7", ZCoordinate=0)
rectangle = Rectangle(Plane=pt_5, XSize="9", YSize="7", Radius=0)  # -> Rectangle, Length
rectangle_2 = Rectangle(Plane=pt_6, XSize="9", YSize="2", Radius=0)  # -> Rectangle, Length
addition = Addition(A="9", B=1)
section = CreateSection(Profile=profile, Material=material, Basic_Offset="Centroid")
support = CreateSupport(Point=[pt, pt_4], Plane=PlaneXY(0, 0, 0), x=True, xx=True, y=True, yy=True, z=True, zz=True)
ln = Line(StartPoint=pt, EndPoint=pt_2)
ln_2 = Line(StartPoint=pt_2, EndPoint=pt_3)
ln_3 = Line(StartPoint=pt_3, EndPoint=pt_4)
series = Series(Start="4", Step=1, Count=addition)
mplane = MeshPlane(Boundary=rectangle.Rectangle, WidthCount="9", HeightCount="7")  # -> Mesh, Area
prop2d = Create2DProperty(Thickness_cm="25", Material=material_2, Type="Shell", Unit="cm")
mplane_2 = MeshPlane(Boundary=rectangle_2.Rectangle, WidthCount="9", HeightCount="2")  # -> Mesh, Area
pt_7 = ConstructPoint(XCoordinate=series, YCoordinate=0, ZCoordinate=0)
elem2d = Create2DElement(Mesh=mplane.Mesh, Prop2D=prop2d, Preview3dSection=False)
support_2 = CreateSupport(Point=pt_7, Plane=PlaneXY(0, 0, 0), x=True, xx=True, y=True, yy=True, z=True, zz=True)
elem2d_2 = Create2DElement(Mesh=mplane_2.Mesh, Prop2D=prop2d, Preview3dSection=False)
elem1d = Create1DElement(Line=ln_2, Section=section, Preview3dSection=False)
elem1d_2 = Create1DElement(Line=[ln, ln_3], Section=section, Preview3dSection=False)
createlist = CreateList(Index=0, Definition=elem2d, Type="Element")
createlist_2 = CreateList(Index=0, Name="Slab edge", Definition=elem2d_2, Type="Element")
createlist_3 = CreateList(Index=0, Name="Columns", Definition=elem1d_2, Type="Element")
createlist_4 = CreateList(Index=0, Definition=elem1d, Type="Element")
faceload = CreateFaceLoad(
    LoadCase=1,
    ElementList=createlist_2,
    Axis=-1,
    Direction="z",
    Projected=False,
    Value_kN_m²="-5",
    Type="Uniform",
    Unit="kN/m²")
beamload = CreateBeamLoad(
    LoadCase=1,
    ElementList=createlist_3,
    Axis=0,
    Direction="y",
    Projected=False,
    Value_kN_m="5",
    Type="Uniform",
    Unit="kN/m")
analyse = AnalyseModel(
    ModelSAndLists=createlist,
    GSAGeometryIn_m=flatten([support_2, elem2d, elem2d_2]),
    Load=faceload,
    Analyse=True,
    ReMesh=True,
    Tolerance=0.01,
    Unit="m")  # -> Model, Report
analyse_2 = AnalyseModel(
    ModelSAndLists=createlist_4,
    GSAGeometryIn_m=[support, elem1d_2, elem1d],
    Load=beamload,
    Analyse=True,
    ReMesh=True,
    Tolerance=0.01,
    Unit="m")  # -> Model, Report
selres = SelectResults(GSAModel=analyse.Model, Type="AnalysisCase", Case_ID="A1")
getlists = GetModelLists(GSAModel=analyse.Model)
item = ListItem(List=getlists, Index=0, Wrap=True)  # -> Item, Item1
contourelem2d = _2DContourResults(
    Result=selres,
    ElementFilterList=createlist_2,
    Display=3,
    Mode=0,
    flayer=0,
    force="kN/m",
    legend=True,
    legendScale=1,
    length="mm",
    model="m",
    moment="kN",
    noDec=0,
    Result_Type="Displacement",
    Component="Resolved |U|",
    slider=True,
    stress="MPa",
    val=10,
    valMax=1000,
    valMin=0)  # -> M, Colours, Values_mm
getlists_2 = GetModelLists(GSAModel=analyse_2.Model)
selres_2 = SelectResults(GSAModel=analyse_2.Model, Type="AnalysisCase", Case_ID="A1")
item_2 = ListItem(List=getlists_2, Index=0, Wrap=True)  # -> Item, Item1
listinfo = ListInfo(List=item.Item1, Unit="m")  # -> Index, Name, Type, Definition, ListObjectsIn_m, ExpandList
listinfo_2 = ListInfo(List=item.Item, Unit="m")  # -> Index, Name, Type, Definition, ListObjectsIn_m, ExpandList
an = Annotate(NodeElementMemberLoadResultDiagram=contourelem2d.M)  # -> Annotations, Position, Text
listinfo_3 = ListInfo(List=item_2.Item1, Unit="m")  # -> Index, Name, Type, Definition, ListObjectsIn_m, ExpandList
listinfo_4 = ListInfo(List=item_2.Item, Unit="m")  # -> Index, Name, Type, Definition, ListObjectsIn_m, ExpandList
contourelem1d = _1DContourResults(
    Result=selres_2,
    ElementFilterList=createlist_3,
    IntermediatePoints=10,
    Scale=10,
    Display=3,
    Mode=0,
    energy="MJ",
    force="kN",
    legend=True,
    legendScale=1,
    length="mm",
    model="m",
    moment="kN·m",
    noDec=0,
    Result_Type="Displacement",
    Component="Resolved |U|",
    slider=True,
    val=150,
    valMax=1000,
    valMin=0)  # -> L, Colours, Values_mm
panel = Panel(listinfo_2.Index)
panel_2 = Panel(listinfo_2.Name)
panel_3 = Panel(listinfo_2.Type)
panel_4 = Panel(listinfo.Index)
panel_5 = Panel(listinfo.Name)
panel_6 = Panel(listinfo.Type)
panel_7 = Panel(listinfo.ListObjectsIn_m)
panel_8 = Panel(listinfo_2.Definition)
panel_9 = Panel(listinfo_2.ListObjectsIn_m)
panel_10 = Panel(listinfo.Definition)
sort = SortList(Keys=listinfo.ExpandList)  # -> Keys, ValuesA
sort_2 = SortList(Keys=an.Text)  # -> Keys, ValuesA
A = Annotate(NodeElementMemberLoadResultDiagram=contourelem1d.L)  # -> Annotations, Position, Text
panel_11 = Panel(listinfo_4.Index)
panel_12 = Panel(listinfo_4.Name)
panel_13 = Panel(listinfo_4.Type)
panel_14 = Panel(listinfo_3.Index)
panel_15 = Panel(listinfo_3.Name)
panel_16 = Panel(listinfo_3.Type)
panel_17 = Panel(listinfo_3.ListObjectsIn_m)
panel_18 = Panel(listinfo_4.Definition)
panel_19 = Panel(listinfo_4.ListObjectsIn_m)
panel_20 = Panel(listinfo_3.Definition)
int = Integer(listinfo_3.ExpandList)
equals = Equality(FirstNumber=sort.Keys, SecondNumber=sort_2.Keys)  # -> Equality, Inequality
demesh = DeconstructMesh(Mesh=listinfo_2.ListObjectsIn_m)  # -> Vertices, Faces, Colours, Normals
demesh_2 = DeconstructMesh(Mesh=listinfo.ListObjectsIn_m)  # -> Vertices, Faces, Colours, Normals
dcon = DeleteConsecutive(Set=A.Text, Wrap=False)  # -> Set, Count
ma = MassAddition(Input=equals.Inequality)  # -> Result, PartialResults
lng = ListLength(List=demesh.Vertices)
lng_2 = ListLength(List=demesh.Faces)
lng_3 = ListLength(List=demesh_2.Vertices)
lng_4 = ListLength(List=demesh_2.Faces)
bang = ExplodeTree(Data=dcon.Set)  # -> Branch0, Branch1
end = EndPoints(Curve=listinfo_3.ListObjectsIn_m)  # -> Start, End
end_2 = EndPoints(Curve=listinfo_4.ListObjectsIn_m)  # -> Start, End

# ---- group: Test6IdsAreEqual
int_2 = Integer(ma.Result)

# ----
item_3 = ListItem(List=int, Index=0, Wrap=True)  # -> Item, Item1

# ---- group: Test4Vertices
int_3 = Integer(lng)

# ---- group: Test4Faces
int_4 = Integer(lng_2)

# ---- group: Test5Vertices
int_5 = Integer(lng_3)

# ---- group: Test5Faces
int_6 = Integer(lng_4)

# ----
pdecon = Deconstruct(Point=end.Start)  # -> XComponent, YComponent, ZComponent
pdecon_2 = Deconstruct(Point=end_2.Start)  # -> XComponent, YComponent, ZComponent
pdecon_3 = Deconstruct(Point=end.End)  # -> XComponent, YComponent, ZComponent
pdecon_4 = Deconstruct(Point=end_2.End)  # -> XComponent, YComponent, ZComponent
equals_2 = Equality(FirstNumber=item_3.Item, SecondNumber=bang.Branch0)  # -> Equality, Inequality
equals_3 = Equality(FirstNumber=item_3.Item1, SecondNumber=bang.Branch1)  # -> Equality, Inequality

# ---- group: Test2StartZs
num = Number(pdecon.ZComponent)

# ---- group: Test1StartZs
num_2 = Number(pdecon_2.ZComponent)

# ---- group: Test2StartYs
num_3 = Number(pdecon.YComponent)

# ---- group: Test1StartYs
num_4 = Number(pdecon_2.YComponent)

# ---- group: Test2EndZs
num_5 = Number(pdecon_3.YComponent)

# ---- group: Test1EndZs
num_6 = Number(pdecon_4.YComponent)

# ---- group: Test2EndYs
num_7 = Number(pdecon_3.XComponent)

# ---- group: Test1EndYs
num_8 = Number(pdecon_4.XComponent)

# ---- group: Test3Result1
bool = Boolean(equals_2.Equality)

# ---- group: Test3Result2
bool_2 = Boolean(equals_3.Equality)
