# Grasshopper definition GsaList_Members.gh (Grasshopper 1.0.7)
# Copyright: Arup
# plug-ins: GSA

number_slider = Slider(2, range=0..10)
number_slider_2 = Slider(3, range=0..10)
number_slider_3 = Slider(6.75, range=0..10)
number_slider_4 = Slider(8.1, range=0..10)
multiplication = Multiplication(A=number_slider_3, B=number_slider_2)
multiplication_2 = Multiplication(A=number_slider_4, B=number_slider)
recgrid = Rectangular(Plane=PlaneXY(0, 0, 0), SizeX=number_slider_3, SizeY=number_slider_4, ExtentX=number_slider_2, ExtentY=number_slider)  # -> Cells, Points
series = Series(Start=Slider(4.5, range=0..10), Step=Slider(3.6, range=0..10), Count=Slider(5, range=0..100))
explode = Explode(Curve=recgrid.Cells, Recursive=True)  # -> Segments, Vertices
rectangle = Rectangle(Plane=PlaneXY(0, 0, 0), XSize=multiplication, YSize=multiplication_2, Radius=0)  # -> Rectangle, Length
pt = Point(recgrid.Points)
rev = ReverseList(List=explode.Segments)
boundary = BoundarySurfaces(Edges=rectangle.Rectangle)
Z = UnitZ(Factor=flatten(["0", series]))
item = ListItem(List=explode.Segments, Index=0, Wrap=True)
item_2 = ListItem(List=explode.Segments, Index="2", Wrap=True)
item_3 = ListItem(List=rev, Index=0, Wrap=True)
item_4 = ListItem(List=rev, Index="2", Wrap=True)  # -> reverse(Item)
move = Move(Geometry=flatten(pt), Motion=graft(Z))  # -> Geometry, Transform
pshift = ShiftPaths(Data=item, Offset=-1)
pshift_2 = ShiftPaths(Data=item_2, Offset=-1)
pshift_3 = ShiftPaths(Data=item_3, Offset=-1)
pshift_4 = ShiftPaths(Data=item_4, Offset=-1)
item_5 = ListItem(List=reverse(pshift_2), Index=0, Wrap=True)
flip = FlipMatrix(Data=pshift_4)
flip_2 = FlipMatrix(Data=move.Geometry)
item_6 = ListItem(List=reverse(flip), Index=0, Wrap=True)
Z_2 = UnitZ(Factor=flatten(series))
pline = PolyLine(Vertices=flip_2, Closed=False)  # -> flatten(Polyline)
ins = InsertItems(List=simplify(item_5), Item=pshift, Indices=simplify("0"), Wrap=True)  # -> flatten(List)
flip_3 = FlipMatrix(Data=item_6)
shift = ShiftList(List=reverse(pt), Shift=1, Wrap=False)
item_7 = ListItem(List=reverse(pt), Index=0, Wrap=True)
ins_2 = InsertItems(List=simplify(flip_3), Item=pshift_3, Indices=simplify("0"), Wrap=True)  # -> flatten(List)
move_2 = Move(Geometry=ins, Motion=graft(Z_2))  # -> flatten(Geometry), Transform
move_3 = Move(Geometry=ins_2, Motion=graft(Z_2))  # -> flatten(Geometry), Transform
move_4 = Move(Geometry=boundary, Motion=Z_2)  # -> Geometry, Transform
support = CreateSupport(Point=flatten([shift, item_7]), Plane=PlaneXY(0, 0, 0), x=True, xx=True, y=True, yy=True, z=True, zz=True)
mem2d = Create2DMember(Brep=move_4.Geometry, InternalOffset=False)
mem2d_2 = Create2DMember(Brep=boundary, InternalOffset=False)
mem1d = Create1DMember(
    Curve=pline,
    x1=False,
    x2=False,
    xx1=False,
    xx2=False,
    y1=False,
    y2=False,
    yy1=False,
    yy2=False,
    z1=False,
    z2=False,
    zz1=False,
    zz2=False)
mem1d_2 = Create1DMember(
    Curve=move_2.Geometry,
    x1=False,
    x2=False,
    xx1=False,
    xx2=False,
    y1=False,
    y2=False,
    yy1=False,
    yy2=False,
    z1=False,
    z2=False,
    zz1=False,
    zz2=False)
mem1d_3 = Create1DMember(
    Curve=move_3.Geometry,
    x1=False,
    x2=False,
    xx1=False,
    xx2=False,
    y1=False,
    y2=False,
    yy1=False,
    yy2=False,
    z1=False,
    z2=False,
    zz1=False,
    zz2=False)
createlist = CreateList(Index="1", Name="Columns", Definition=mem1d, Type="Member")
createlist_2 = CreateList(Index="3", Name="Primaries", Definition=mem1d_2, Type="Member")
createlist_3 = CreateList(Index="4", Definition=mem1d_3, Type="Member")
createlist_4 = CreateList(Index=0, Name="Typical Floors", Definition=mem2d, Type="Member")
createlist_5 = CreateList(Index="11", Name="Ground floor", Definition=mem2d_2, Type="Member")
model = CreateModel(
    ModelSAndLists=[createlist, createlist_2, createlist_3, createlist_4, createlist_5],
    GSAGeometryIn_m=[support, mem1d, mem1d_2, mem1d_3, mem2d, mem2d_2],
    ReMesh=True,
    Tolerance=0.01,
    Unit="m")
getlists = GetModelLists(GSAModel=model)
item_8 = ListItem(List=getlists, Index=0, Wrap=True)  # -> Item, Item1, Item2, Item3, Item4
listinfo = ListInfo(List=item_8.Item, Unit="m")  # -> Index, Name, Type, Definition, ListObjects_m
listinfo_2 = ListInfo(List=item_8.Item3, Unit="m")  # -> Index, Name, Type, Definition, ListObjects_m
listinfo_3 = ListInfo(List=item_8.Item1, Unit="m")  # -> Index, Name, Type, Definition, ListObjects_m
listinfo_4 = ListInfo(List=item_8.Item4, Unit="m")  # -> Index, Name, Type, Definition, ListObjects_m
listinfo_5 = ListInfo(List=item_8.Item2, Unit="m")  # -> Index, Name, Type, Definition, ListObjects_m
lng = ListLength(List=listinfo.ListObjects_m)
lng_2 = ListLength(List=listinfo_2.ListObjects_m)
lng_3 = ListLength(List=listinfo_3.ListObjects_m)
lng_4 = ListLength(List=listinfo_4.ListObjects_m)
lng_5 = ListLength(List=listinfo_5.ListObjects_m)

# ---- group: Test4Id
int = Integer(listinfo_2.Index)

# ---- group: Test4Name
txt = Text(listinfo_2.Name)

# ---- group: Test4Type
txt_2 = Text(listinfo_2.Type)

# ---- group: Test4Count
int_2 = Integer(lng_2)

# ---- group: Test5Id
int_3 = Integer(listinfo_4.Index)

# ---- group: Test5Name
txt_3 = Text(listinfo_4.Name)

# ---- group: Test5Type
txt_4 = Text(listinfo_4.Type)

# ---- group: Test5Count
int_4 = Integer(lng_4)

# ---- group: Test1Id
int_5 = Integer(listinfo.Index)

# ---- group: Test1Name
txt_5 = Text(listinfo.Name)

# ---- group: Test1Type
txt_6 = Text(listinfo.Type)

# ---- group: Test1Count
int_6 = Integer(lng)

# ---- group: Test2Id
int_7 = Integer(listinfo_3.Index)

# ---- group: Test2Name
txt_7 = Text(listinfo_3.Name)

# ---- group: Test2Type
txt_8 = Text(listinfo_3.Type)

# ---- group: Test2Count
int_8 = Integer(lng_3)

# ---- group: Test3Id
int_9 = Integer(listinfo_5.Index)

# ---- group: Test3Name
txt_9 = Text(listinfo_5.Name)

# ---- group: Test3Type
txt_10 = Text(listinfo_5.Type)

# ---- group: Test3Count
int_10 = Integer(lng_5)
