# Grasshopper definition GsaList_Nodes.gh (Grasshopper 1.0.7)
# Copyright: Arup
# plug-ins: GSA

series = Series(Start=0, Step=1, Count=10)
neg = Negative(Value="8")
neg_2 = Negative(Value="10")
profile = CreateProfile(
    Depth_cm="40",
    Width_cm="40",
    NumberOfInputs=2,
    catalogueIndex=-1,
    inclSS=False,
    lengthUnit="Centimeter",
    mode="Other",
    Profile_type="Rectangle",
    Measure="cm",
    typeIndex=-1)
material = CustomMaterial(
    ElasticModulus_MPa="30000",
    PoissonsRatio="0.25",
    Density_kg_m³="2500",
    Material_Type="Timber",
    Stress_Unit="MPa",
    Density_Unit="kg/m³",
    Temperature_Unit="°C")
pt = ConstructPoint(XCoordinate="-6", YCoordinate="-9", ZCoordinate=0)
pt_2 = ConstructPoint(XCoordinate="-3", YCoordinate="-4", ZCoordinate=0)
pt_3 = ConstructPoint(XCoordinate=series, YCoordinate=graft(series), ZCoordinate=0)
pt_4 = ConstructPoint(XCoordinate="4", YCoordinate="4", ZCoordinate=0)
pt_5 = ConstructPoint(XCoordinate="6", YCoordinate="7", ZCoordinate=0)
pt_6 = ConstructPoint(XCoordinate="-6", YCoordinate="10", ZCoordinate=0)
pt_7 = ConstructPoint(XCoordinate="-6", YCoordinate="2", ZCoordinate=0)
pt_8 = ConstructPoint(XCoordinate="-6", YCoordinate="4.5", ZCoordinate=0)
rectangle = Rectangle(Plane=PlaneXY(0, 0, 0), XSize=neg, YSize=neg_2, Radius=0)  # -> Rectangle, Length
support = CreateSupport(Point=[pt_2, pt], Plane=PlaneXY(0, 0, 0), x=False, xx=False, y=False, yy=False, z=False, zz=False)
mplane = MeshPlane(Boundary=rectangle.Rectangle, WidthCount="8", HeightCount="10")  # -> Mesh, Area
support_2 = CreateSupport(Point=flatten(pt_3), Plane=PlaneXY(0, 0, 0), x=False, xx=False, y=False, yy=False, z=False, zz=False)
support_3 = CreateSupport(Point=[pt_4, pt_5], Plane=PlaneXY(0, 0, 0), x=False, xx=False, y=False, yy=False, z=False, zz=False)
createlist = CreateList(Index=0, Definition=support, Type="Node")
elem2d = Create2DElement(Mesh=mplane.Mesh)
section = CreateSection(Profile=profile, Material=material)
support_4 = CreateSupport(Point=[pt_7, pt_6], Plane=PlaneXY(0, 0, 0), x=True, xx=True, y=True, yy=True, z=True, zz=True)
pline = PolyLine(Vertices=[pt_7, pt_8, pt_6], Closed=False)
createlist_2 = CreateList(Index=0, Definition=support_3, Type="Node")
createlist_3 = CreateList(Index=0, Name="Load", Definition=pt_8, Type="Node")
nodeload = CreateNodeLoad(LoadCase=1, NodeList=createlist, Direction="z", Value_kN="-5", Type="Node Force", Unit="kN")
mem1d = Create1DMember(
    Curve=pline,
    Section=section,
    x1=False,
    x2=False,
    xx1=False,
    xx2=False,
    y1=False,
    y2=False,
    yy1=True,
    yy2=True,
    z1=False,
    z2=False,
    zz1=False,
    zz2=False)
model = CreateModel(ModelSAndLists=createlist_2, GSAGeometryIn_m=support_2, ReMesh=False, Tolerance=0.01, Unit="m")
model_2 = CreateModel(GSAGeometryIn_m=elem2d, Load=nodeload, ReMesh=True, Tolerance=0.01, Unit="m")
getlists = GetModelLists(GSAModel=model)
nodeload_2 = CreateNodeLoad(LoadCase=1, NodeList=createlist_3, Direction="z", Value_kN="-500", Type="Node Force", Unit="kN")
getlists_2 = GetModelLists(GSAModel=model_2)
listinfo = ListInfo(List=getlists, Unit="m")  # -> Index, Name, Type, Definition, ListObjects_m
analyse = AnalyseModel(GSAGeometryIn_m=[mem1d, support_4], Load=nodeload_2, Analyse=True, ReMesh=True, Tolerance=0.01, Unit="m")
listinfo_2 = ListInfo(List=getlists_2, Unit="m")  # -> Index, Name, Type, Definition, ListObjects_m
panel = Panel(listinfo.Index)
panel_2 = Panel(listinfo.Name)
panel_3 = Panel(listinfo.Type)
panel_4 = Panel(listinfo.Definition)
panel_5 = Panel(listinfo.ListObjects_m)
selres = SelectResults(GSAModel=analyse, Type="AnalysisCase", Case_ID="A1")
panel_6 = Panel(listinfo_2.Index)
panel_7 = Panel(listinfo_2.Name)
panel_8 = Panel(listinfo_2.Type)
panel_9 = Panel(listinfo_2.Definition)
panel_10 = Panel(listinfo_2.ListObjects_m)
pt_9 = Point(listinfo.ListObjects_m)
contournode = NodeContourResults(
    Result=selres,
    NodeFilterList=createlist_3,
    Scalar=10,
    Display=3,
    Mode=0,
    force="kN",
    legend=True,
    length="mm",
    model="m",
    moment="kN·m",
    noDec=0,
    Result_Type="Displacement",
    Component="Resolved |U|",
    slider=True,
    val=10,
    valMax=1000,
    valMin=0)  # -> P, Colours, Values_mm
pdecon = Deconstruct(Point=pt_9)  # -> XComponent, YComponent, ZComponent
pt_10 = Point(listinfo_2.ListObjects_m)

# ---- group: Test1Xs
num = Number(pdecon.XComponent)

# ---- group: Test1Ys
num_2 = Number(pdecon.YComponent)

# ----
pdecon_2 = Deconstruct(Point=pt_10)  # -> XComponent, YComponent, ZComponent
pdecon_3 = Deconstruct(Point=contournode.P)  # -> XComponent, YComponent, ZComponent

# ---- group: Test2Xs
num_3 = Number(pdecon_2.XComponent)

# ---- group: Test2Ys
num_4 = Number(pdecon_2.YComponent)

# ---- group: Test3X
num_5 = Number(pdecon_3.XComponent)

# ---- group: Test3Y
num_6 = Number(pdecon_3.YComponent)
