# Grasshopper definition CreateBool6Test.gh (Grasshopper 1.0.7)
# Copyright: Arup
# plug-ins: GSA

panel = Panel("""False
True
0
1
Free
Pin
Fix
rrrrrr
frrrrr
ffrrrr
fffrrr
ffffrr
fffffr
ffffff""")
nodeedit = EditNode(NodeRestraints=panel, Mode=1)  # -> Node, NodeNumber, NodePosition, NodeLocalAxis, NodeRestraints, DamperProperty, MassProperty, SpringProperty, NodeName, NodeColour
pt = ConstructPoint(XCoordinate=0, YCoordinate=0, ZCoordinate=0)
support = CreateSupport(Point=pt, Plane=PlaneXY(0, 0, 0), Restraints=nodeedit.NodeRestraints, x=True, xx=True, y=True, yy=True, z=True, zz=True)
mem1dedit = Edit1DMember(StartRelease=panel, Preview3dSection=False)  # -> Member1D, Member1dNumber, Curve, Section, MemberGroup, MemberType, _1DElementType, Offset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
b6 = CreateBool6(
    X=Toggle(True),
    Y=Toggle(False),
    Z=Toggle(True),
    XX=Toggle(False),
    YY=Toggle(True),
    ZZ=Toggle(False),
    x=True,
    xx=False,
    y=False,
    yy=True,
    z=True,
    zz=False)
nodeedit_2 = EditNode(Node=support, Mode=1)  # -> Node, NodeNumber, NodePosition, NodeLocalAxis, NodeRestraints, DamperProperty, MassProperty, SpringProperty, NodeName, NodeColour
pt_2 = ConstructPoint(XCoordinate=0, YCoordinate=0, ZCoordinate=0)
nodeedit_3 = EditNode(Node=pt_2, NodeRestraints=nodeedit.NodeRestraints, Mode=1)  # -> Node, NodeNumber, NodePosition, NodeLocalAxis, NodeRestraints, DamperProperty, MassProperty, SpringProperty, NodeName, NodeColour
bool6edit = EditBool6(Bool6=nodeedit_2.NodeRestraints)  # -> Bool6, X, Y, Z, XX, YY, ZZ
bool6edit_2 = EditBool6(Bool6=nodeedit.NodeRestraints)  # -> Bool6, X, Y, Z, XX, YY, ZZ
bool6edit_3 = EditBool6(Bool6=b6)  # -> Bool6, X, Y, Z, XX, YY, ZZ
b6_2 = Bool6(nodeedit.NodeRestraints)
panel_2 = Panel("""GSA Bool6 (X☐ Y☐ Z☐ XX☐ YY☐ ZZ☐)
GSA Bool6 (X✓ Y✓ Z✓ XX✓ YY✓ ZZ✓)
GSA Bool6 (X☐ Y☐ Z☐ XX☐ YY☐ ZZ☐)
GSA Bool6 (X✓ Y✓ Z✓ XX✓ YY✓ ZZ✓)
GSA Bool6 (X☐ Y☐ Z☐ XX☐ YY☐ ZZ☐)
GSA Bool6 (X✓ Y✓ Z✓ XX☐ YY☐ ZZ☐)
GSA Bool6 (X✓ Y✓ Z✓ XX✓ YY✓ ZZ✓)
GSA Bool6 (X☐ Y☐ Z☐ XX☐ YY☐ ZZ☐)
GSA Bool6 (X✓ Y☐ Z☐ XX☐ YY☐ ZZ☐)
GSA Bool6 (X✓ Y✓ Z☐ XX☐ YY☐ ZZ☐)
GSA Bool6 (X✓ Y✓ Z✓ XX☐ YY☐ ZZ☐)
GSA Bool6 (X✓ Y✓ Z✓ XX✓ YY☐ ZZ☐)
GSA Bool6 (X✓ Y✓ Z✓ XX✓ YY✓ ZZ☐)
GSA Bool6 (X✓ Y✓ Z✓ XX✓ YY✓ ZZ✓)""")

# ---- group: X
bool = Boolean(bool6edit_3.X)

# ---- group: Y
bool_2 = Boolean(bool6edit_3.Y)

# ---- group: Z
bool_3 = Boolean(bool6edit_3.Z)

# ---- group: XX
bool_4 = Boolean(bool6edit_3.XX)

# ---- group: YY
bool_5 = Boolean(bool6edit_3.YY)

# ---- group: ZZ
bool_6 = Boolean(bool6edit_3.ZZ)

# ----
panel_3 = Panel(bool)
panel_4 = Panel(bool_2)
panel_5 = Panel(bool_3)
panel_6 = Panel(bool_4)
panel_7 = Panel(bool_5)
panel_8 = Panel(bool_6)
panel_9 = Panel(bool6edit.Bool6)
panel_10 = Panel(b6_2)
panel_11 = Panel(bool6edit_2.Bool6)
panel_12 = Panel(nodeedit_3.NodeRestraints)
expression = Expression(x=panel_2, y=panel_10, Expression="if(x=y, True, False)")
expression_2 = Expression(x=panel_2, y=panel_9, Expression="if(x=y, True, False)")
expression_3 = Expression(x=panel_2, y=panel_12, Expression="if(x=y, True, False)")
expression_4 = Expression(x=panel_2, y=panel_11, Expression="if(x=y, True, False)")
cset = CreateSet(List=[expression_2, expression, expression_4, expression_3])  # -> Set, Map
item = ListItem(List=cset.Set, Index="0", Wrap=True)
item_2 = ListItem(List=cset.Set, Index="1", Wrap=True)
and = GateAnd(A=item, B=item_2)

# ---- group: Cast
bool_7 = Boolean(and)

# ----
panel_13 = Panel(bool_7)
