# Grasshopper definition CreateEditBucklingFactors.gh (Grasshopper 1.0.7)
# plug-ins: GSA

pt = ConstructPoint(XCoordinate=0, YCoordinate=0, ZCoordinate=0)
line = LineSDL(Start=pt, Direction=Vector(0, 0, 1), Length="10")
fls = CreateBucklingLengthFactors(FactorLsy="1", FactorLsz="1.5", FactorLtb="2")
mem1dedit = Edit1DMember(Curve=line, SetBucklingLengthFactors=fls, LengthUnit="Meter")  # -> Member1D, Member1dNumber, Curve, Section, MemberGroup, MemberType, _1DElementType, Offset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
bucklingfactorsedit = EditBucklingLengthFactors(BucklingLengthFactors=mem1dedit.GetBucklingLengthFactors)  # -> BucklingLengthFactors, FactorLsy, FactorLsz, FactorLtb, BucklingLYY, BucklingLZZ, LTBLength

# ---- group: TestLsy
num = Number(bucklingfactorsedit.BucklingLYY)

# ---- group: TestLsz
num_2 = Number(bucklingfactorsedit.BucklingLZZ)

# ---- group: TestLtb
num_3 = Number(bucklingfactorsedit.LTBLength)

# ----
panel = Panel([num, num_2, num_3])
