# Grasshopper definition CreateProfile.gh (Grasshopper 1.0.7)
# Copyright: Arup
# plug-ins: GSA

rectangle = Rectangle(Plane=PlaneXY(0, 0, 0), XSize=Domain(-1, 1), YSize=Domain(-2, 2), Radius=0)  # -> Rectangle, Length
profile = CreateProfile(
    Depth_mm="100",
    Width_mm="500",
    catalogueIndex=-1,
    lengthUnit="Millimeter",
    mode="Other",
    Profile_type="Recto Circle",
    Measure="mm",
    typeIndex=-1)
profile_2 = CreateProfile(
    Diameter_mm="500",
    PileCentres_mm="100",
    PileCount="10",
    IsWall=Toggle(False),
    catalogueIndex=-1,
    lengthUnit="Millimeter",
    mode="Other",
    Profile_type="Secant Pile",
    Measure="mm",
    typeIndex=-1)
profile_3 = CreateProfile(
    Depth_mm="500",
    DepthFlat_mm="400",
    Width_mm="350",
    WidthFlat_mm="300",
    catalogueIndex=-1,
    lengthUnit="Millimeter",
    mode="Other",
    Profile_type="Recto Ellipse",
    Measure="mm",
    typeIndex=-1)
profile_4 = CreateProfile(
    Depth_mm="500",
    Width_mm="100",
    WebThk_mm="10",
    FlangeThk_mm="20",
    catalogueIndex=-1,
    lengthUnit="Millimeter",
    mode="Other",
    Profile_type="I Beam Symmetrical",
    Measure="mm",
    typeIndex=-1)
profile_5 = CreateProfile(
    Depth_mm="500",
    Width_mm="100",
    WebThk_mm="10",
    FlangeThk_mm="20",
    catalogueIndex=-1,
    lengthUnit="Millimeter",
    mode="Other",
    Profile_type="T Section",
    Measure="mm",
    typeIndex=-1)
profile_6 = CreateProfile(
    Depth_mm="500",
    Width_mm="100",
    TopFlangeWidth_mm="10",
    BottomFlangeWidth_mm="20",
    FlangeThickness_mm="30",
    WebThickness_mm="30",
    catalogueIndex=-1,
    lengthUnit="Millimeter",
    mode="Other",
    Profile_type="Sheet Pile",
    Measure="mm",
    typeIndex=-1)
profile_7 = CreateProfile(
    Depth_mm="500",
    Width_mm="100",
    WebThk_mm="10",
    FlangeThk_mm="20",
    catalogueIndex=-1,
    lengthUnit="Millimeter",
    mode="Other",
    Profile_type="Angle",
    Measure="mm",
    typeIndex=-1)
profile_8 = CreateProfile(
    Depth_cm="50",
    Width_cm="10",
    WebThk_cm="1",
    FlangeThk_cm="2",
    catalogueIndex=-1,
    lengthUnit="Centimeter",
    mode="Other",
    Profile_type="Channel",
    Measure="cm",
    typeIndex=-1)
profile_9 = CreateProfile(
    Depth_mm="500",
    Width_mm="100",
    catalogueIndex=-1,
    lengthUnit="Millimeter",
    mode="Other",
    Profile_type="Rectangle",
    Measure="mm",
    typeIndex=-1)
profile_10 = CreateProfile(
    Depth_mm="500",
    TopWidth_mm="100",
    BottomWidth_mm="10",
    catalogueIndex=-1,
    lengthUnit="Millimeter",
    mode="Other",
    Profile_type="Trapezoid",
    Measure="mm",
    typeIndex=-1)
profile_11 = CreateProfile(
    Diameter_m="5",
    Thickness_m="0.1",
    catalogueIndex=-1,
    lengthUnit="Meter",
    mode="Other",
    Profile_type="Circle Hollow",
    Measure="m",
    typeIndex=-1)
profile_12 = CreateProfile(
    Depth_mm="500",
    Width_mm="100",
    WebThk_mm="10",
    FlangeThk_mm="20",
    WebOpening_mm="300",
    Pitch_mm="3000",
    catalogueIndex=-1,
    lengthUnit="Millimeter",
    mode="Other",
    Profile_type="I Beam Cellular",
    Measure="mm",
    typeIndex=-1)
profile_13 = CreateProfile(
    Boundary=rectangle.Rectangle,
    catalogueIndex=-1,
    lengthUnit="Meter",
    mode="Other",
    Profile_type="Perimeter",
    Measure="m",
    typeIndex=-1)
profile_14 = CreateProfile(Diameter_in="11", catalogueIndex=-1, lengthUnit="Inch", mode="Other", Profile_type="Circle", Measure="in", typeIndex=-1)
profile_15 = CreateProfile(
    Depth_mm="500",
    Width_mm="100",
    WebThk_mm="10",
    FlangeThk_mm="20",
    catalogueIndex=-1,
    lengthUnit="Millimeter",
    mode="Other",
    Profile_type="Rectangle Hollow",
    Measure="mm",
    typeIndex=-1)
profile_16 = CreateProfile(
    Depth_mm="500",
    Width_mm="100",
    WebThk_mm="10",
    FlangeThk_mm="20",
    catalogueIndex=-1,
    lengthUnit="Millimeter",
    mode="Other",
    Profile_type="Cruciform Symmetrical",
    Measure="mm",
    typeIndex=-1)
profile_17 = CreateProfile(
    Depth_mm="500",
    TopWidth_mm="100",
    BottomWidth_mm="10",
    TopLip_mm="20",
    Lip_mm="30",
    Thickness_mm="30",
    catalogueIndex=-1,
    lengthUnit="Millimeter",
    mode="Other",
    Profile_type="General Z",
    Measure="mm",
    typeIndex=-1)
profile_18 = CreateProfile(
    Depth_mm="500",
    Width_mm="100",
    Thickness_mm="10",
    catalogueIndex=-1,
    lengthUnit="Millimeter",
    mode="Other",
    Profile_type="Ellipse Hollow",
    Measure="mm",
    typeIndex=-1)
profile_19 = CreateProfile(
    Depth_mm="500",
    Width_mm="100",
    Lip_mm="10",
    Thickness_mm="20",
    catalogueIndex=-1,
    lengthUnit="Millimeter",
    mode="Other",
    Profile_type="General C",
    Measure="mm",
    typeIndex=-1)
profile_20 = CreateProfile(
    Depth_mm="500",
    TopFlangeWidth_mm="100",
    BottomFlangeWidth_mm="10",
    WebThickness_mm="20",
    TopFlangeThk_mm="30",
    BottomFlangeThk_mm="30",
    catalogueIndex=-1,
    lengthUnit="Millimeter",
    mode="Other",
    Profile_type="I Beam Asymmetrical",
    Measure="mm",
    typeIndex=-1)
join = TextJoin(Text=[profile_3, " 2"])

# ---- group: Angle
txt = Text(profile_7)

# ---- group: CircleHollow
txt_2 = Text(profile_11)

# ---- group: Channel
txt_3 = Text(profile_8)

# ---- group: Circle
txt_4 = Text(profile_14)

# ---- group: CruciformSymmetrical
txt_5 = Text(profile_16)

# ---- group: EllipseHollow
txt_6 = Text(profile_18)

# ---- group: GeneralC
txt_7 = Text(profile_19)

# ---- group: GeneralZ
txt_8 = Text(profile_17)

# ---- group: IBeamSymmetrical
txt_9 = Text(profile_4)

# ---- group: IBeamAsymmetrical
txt_10 = Text(profile_20)

# ---- group: Perimeter
txt_11 = Text(profile_13)

# ---- group: IBeamCellular
txt_12 = Text(profile_12)

# ---- group: RectangleHollow
txt_13 = Text(profile_15)

# ---- group: RectoCircle
txt_14 = Text(profile)

# ---- group: SheetPile
txt_15 = Text(profile_6)

# ---- group: Rectangle
txt_16 = Text(profile_9)

# ---- group: RectoEllipse
txt_17 = Text(join)

# ---- group: T
txt_18 = Text(profile_5)

# ---- group: SecantPile
txt_19 = Text(profile_2)

# ---- group: Trapezoid
txt_20 = Text(profile_10)

# ----
panel = Panel(txt_15)
panel_2 = Panel(txt_20)
panel_3 = Panel(txt_19)
panel_4 = Panel(txt_18)
panel_5 = Panel(txt_9)
panel_6 = Panel(txt_2)
panel_7 = Panel(txt_10)
panel_8 = Panel(txt_12)
panel_9 = Panel(txt_11)
panel_10 = Panel(txt_13)
panel_11 = Panel(txt_8)
panel_12 = Panel(txt)
panel_13 = Panel(txt_16)
panel_14 = Panel(txt_14)
panel_15 = Panel(txt_3)
panel_16 = Panel(txt_4)
panel_17 = Panel(txt_7)
panel_18 = Panel(txt_5)
panel_19 = Panel(txt_6)
panel_20 = Panel(txt_17)
