# Grasshopper definition EditOffsetTest.gh (Grasshopper 1.0.7)
# Copyright: Arup
# plug-ins: GSA

offset = CreateOffset(OffsetX1_m="1", OffsetX2_m="2", OffsetY_m="3", OffsetZ_m="4", Measure="Meter")
offsetedit = EditOffset(Offset=offset, OffsetX1_mm="4", OffsetX2_mm="3", OffsetY_mm="2", OffsetZ_mm="1")  # -> Offset, OffsetX1_mm, OffsetX2_mm, OffsetY_mm, OffsetZ_mm
panel = Panel(offset)

# ---- group: Of
off = Offset(offsetedit.Offset)

# ----
panel_2 = Panel(off)
