# Grasshopper definition GetProperties_TrGen_10.gh (Grasshopper 1.0.7)
# plug-ins: GSA

panel = Panel("https://samples.oasys-software.com/gsa/10.1/Training_General/TrGen_10.gwb")
c_script = CSharpScript(x=panel)  # -> A; inputs x: String
# ---------- c_script: C# ----------
    string fileName = System.IO.Path.GetTempPath();

    //create webclient and download example file:
    System.Net.WebClient webClient = new System.Net.WebClient();
    webClient.DownloadFile(
      x,
      fileName + "Steel_Design_Simple.gwb");

    A = fileName + "Steel_Design_Simple.gwb";
# ---------- end c_script ----------
open = OpenModel(FilenameAndPath=c_script, File="C:\Users\kristjan.nielsen\AppData\Local\Temp\Steel_Design_Simple.gwb")
getprops = GetModelProperties(GSAModel=open)  # -> Sections, _2DProperties, _3DProperties
sectionedit = EditSection(Section=getprops.Sections)  # -> Section, SectionNumber, SectionProfile, Material, Section_2, SectionPool, SectionName, SectionColour
materialedit = EditMaterial(Material=sectionedit.Material)  # -> Material, AnalysisProperty, MaterialType, MaterialGrade
matprop = MaterialProperties(
    Material=materialedit.Material,
    DensityUnit="KilogramPerCubicMeter",
    StressUnit="Megapascal",
    TemperatureUnit="DegreeCelsius")  # -> ElasticModulus_MPa, PoissonsRatio, Density_kg_m³, ThermalExpansion_C_¹

# ---- group: PbIds
int = Integer(sectionedit.SectionNumber)

# ---- group: Profiles
txt = Text(sectionedit.SectionProfile)

# ----
panel_2 = Panel(int)
panel_3 = Panel(txt)
