# Grasshopper definition CreateEffectiveLengthOptions.gh (Grasshopper 1.0.7)
# plug-ins: GSA

pt = ConstructPoint(XCoordinate=0, YCoordinate=0, ZCoordinate=0)
effectivelengthoptions = CreateEffectiveLengthOptions(
    DestabilisingLoadHeight=0,
    FactorLsy="0.9",
    FactorLsz="1.5",
    EquivalentUniformMomentFactorForLTB="2",
    Options="Automatic",
    Load_position="Shear centre")
line = LineSDL(Start=pt, Direction=Vector(0, 0, 1), Length="10")
bfs = CreateBucklingFactors(FactorLsy="1")
bfs_2 = CreateBucklingFactors(FactorLsz="1")
bfs_3 = CreateBucklingFactors(EquivalentUniformMomentFactorForLTB="1")
bucklingfactorsedit = EditBucklingFactors(BucklingFactors=bfs)  # -> BucklingFactors, FactorLsy, FactorLsz, EquivalentUniformMomentFactorForLTB
bucklingfactorsedit_2 = EditBucklingFactors(BucklingFactors=bfs_2)  # -> BucklingFactors, FactorLsy, FactorLsz, EquivalentUniformMomentFactorForLTB
bucklingfactorsedit_3 = EditBucklingFactors(BucklingFactors=bfs_3)  # -> BucklingFactors, FactorLsy, FactorLsz, EquivalentUniformMomentFactorForLTB
mem1dedit = Edit1DMember(Curve=line, SetBucklingFactors=effectivelengthoptions, Preview3dSection=False)  # -> Member1D, Member1dNumber, Curve, Section, MemberGroup, MemberType, _1DElementType, Offset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
null = NullItem(Item=[bucklingfactorsedit.FactorLsz, bucklingfactorsedit.EquivalentUniformMomentFactorForLTB])  # -> NullFlags, InvalidFlags, Description
null_2 = NullItem(Item=[bucklingfactorsedit_2.FactorLsy, bucklingfactorsedit_2.EquivalentUniformMomentFactorForLTB])  # -> NullFlags, InvalidFlags, Description
null_3 = NullItem(Item=[bucklingfactorsedit_3.FactorLsy, bucklingfactorsedit_3.FactorLsz])  # -> NullFlags, InvalidFlags, Description
effectivelengthoptions_2 = GetEffectiveLengthOptions(EffectiveLengthOptions=mem1dedit.GetBucklingFactors)  # -> CO, ER1, ER2, RAM, IBR, Lsy, Lsz, Ltb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
not = GateNot(A=null.NullFlags)
not_2 = GateNot(A=null_2.NullFlags)
not_3 = GateNot(A=null_3.NullFlags)

# ---- group: TestLsy
num = Number(effectivelengthoptions_2.fLy)

# ---- group: TestLsz
num_2 = Number(effectivelengthoptions_2.fLz)

# ---- group: TestLtb
num_3 = Number(effectivelengthoptions_2.fLtb)

# ----
ma = MassAddition(Input=flatten([not, not_2, not_3]))  # -> Result, PartialResults
panel = Panel([num, num_2, num_3])

# ---- group: null tests
int = Integer(ma.Result)
